% Simulink data dictionary dd_foc_configuration_parameter.sldd
% references dd_foc_data_type.sldd

Cdbl_iPhCurrPeakVal = Simulink.Parameter(256, DataType="double")
Cdbl_uCtlBrdVltgMaxVal = Simulink.Parameter(0.99997, DataType="double")
Cdbl_iSplyCurrPeakVal = Simulink.Parameter(256, DataType="double")
Cdbl_facDaxCurrCtlKiMaxVal = Simulink.Parameter(1999.93896, DataType="double")
Cdbl_facDaxCurrCtlKpMaxVal = Simulink.Parameter(1.11111, DataType="double")
Cdbl_facQaxCurrCtlKiMaxVal = Simulink.Parameter(1999.93896, DataType="double")
Cdbl_facQaxCurrCtlKpMaxVal = Simulink.Parameter(1.11111, DataType="double")
Cdbl_facDrtnVltgFltCoeffMaxVal = Simulink.Parameter(0.3, DataType="double")
Cdbl_phiEstElecAgDvtMaxVal = Simulink.Parameter(0.5, DataType="double")
Cdbl_numPPNumMaxVal = Simulink.Parameter(6, DataType="double")
Cdbl_numPPNumMinVal = Simulink.Parameter(2, DataType="double")
Cdbl_uSplyVltgPeakVal = Simulink.Parameter(64, DataType="double")
Cdbl_numSplyVltgMAFSmpNum = Simulink.Parameter(40, DataType="double")
Cdbl_numCtlBrdVltgMAFSmpNum = Simulink.Parameter(40, DataType="double")

Cdbl_nElecAgSpdMaxVal = Simulink.Parameter(0.99997, DataType="double")  % Maximum electric speed in [rad/s] is computed as:
  % w_max = n_max*pole_num*pi/30
  % w_max  = parElctSpdMaxVal [rad/s] (maximum electric speed)
  % n_max = 8000 [rpm] (maximum electric speed)
  % pole_num = 5 (number of pole pairs)

Cdbl_nMechSpdPeakVal = Simulink.Parameter(32768, DataType="double")
Cdbl_nElecAgSpdPeakVal = Simulink.Parameter(4096, DataType="double")
Cdbl_uPhVltgMaxVal = Simulink.Parameter(0.99997, DataType="double")
Cdbl_uSplyVltgMaxVal = Simulink.Parameter(0.99997, DataType="double")
Cdbl_trqTqMaxVal = Simulink.Parameter(0.99997, DataType="double")
Cdbl_uSplyVltgMinVal = Simulink.Parameter(0.09375, DataType="double")
Cdbl_iPhCurrMaxVal = Simulink.Parameter(0.45, DataType="double")
Cdbl_pwrElecPwrPeakVal = Simulink.Parameter(1000, DataType="double")
Cdbl_pwrElecPwrMaxVal = Simulink.Parameter(0.5, DataType="double")
Cdbl_iSplyCurrMaxVal = Simulink.Parameter(0.45, DataType="double")
Cdbl_numSplyCurrMAFSmpNum = Simulink.Parameter(40, DataType="double")
Cdbl_numPhCurrMAFSmpNum = Simulink.Parameter(20, DataType="double")
Cdbl_uCtlBrdVltgPeakVal = Simulink.Parameter(64, DataType="double")
Cdbl_nMechSpdMaxVal = Simulink.Parameter(0.30517578, DataType="double")
Cdbl_fEstAgDvtCompFrqMaxVal = Simulink.Parameter(2000, DataType="double")
Cdbl_fEstAgDvtCompFrqMinVal = Simulink.Parameter(70.625, DataType="double")
Cdbl_facSpdFltCoeffMaxVal = Simulink.Parameter(0.3, DataType="double")
Cdbl_facSpdFltCoeffMinVal = Simulink.Parameter(0.030517578125, DataType="double")
Cdbl_FstTaskSmpTiMaxVal = Simulink.Parameter(0.000125, DataType="double")
Cdbl_phiMaxMedTaskElecAgVrnt = Simulink.Parameter(1.570796, DataType="double")
Cdbl_numCalibAlgnNum = Simulink.Parameter(2, DataType="double")
Cdbl_facOpnLpClsLpAgRiseRateMaxVal = Simulink.Parameter(600, DataType="double")
Cdbl_facSpdCtlKiMaxVal = Simulink.Parameter(99.99695, DataType="double")
Cdbl_facStrtUpTqRiseRateMaxVal = Simulink.Parameter(6000, DataType="double")
Cdbl_trqTqPeakVal = Simulink.Parameter(2, DataType="double")
Cdbl_dcycDycMaxVal = Simulink.Parameter(1, DataType="double")

BUS_OBD_SLW_TASK_OUT_SENLVRNT = Simulink.Bus(DataScope="Exported", HeaderFile="motor_control_interface.h")
  busOBD_FaltSt: Bus: BUS_OBD_FALT_STS
  u8_stMaxFaltLvl: uint8  % Reference Direct and Quadrature curents
  s16_nFaltRefMechSpd: dt_Standardize_s16p15b0  % Reference Direct and Quadrature curents
  s16_trqFaltRefTqLim: dt_Standardize_s16p15b0  % Reference Direct and Quadrature curents

BUS_OBD_SLW_TASK_OUT_SENSVRNT = Simulink.Bus(DataScope="Exported", HeaderFile="motor_control_interface.h")
  busOBD_FaltSt: Bus: BUS_OBD_FALT_STS
  u8_stMaxFaltLvl: uint8  % Reference Direct and Quadrature curents
  s16_nFaltRefMechSpd: dt_Standardize_s16p15b0  % Reference Direct and Quadrature curents
  s16_trqFaltRefTqLim: dt_Standardize_s16p15b0  % Reference Direct and Quadrature curents

BUS_DCYCGEN_FST_TASK_IN_SENLVRNT = Simulink.Bus()
  u16_ampDycAmp: dt_DutyCycl_u16p15b0  % Duty cycle amplitude
  u16_phiActElecAg: dt_RadAng_u16r15b0  % Electric angle
  u16_phiDaxQaxVltgAg: dt_RadAng_u16r15b0  % Voltage angle
  enm_stMotoSt: Enum: ENM_MOTO_STATUS  % Motor status
  s16_nPredActElecSpd: dt_Standardize_s16p15b0  % Predicted electric speed

BUS_DCYCGEN_FST_TASK_IN_SENSVRNT = Simulink.Bus(DataScope="Exported", HeaderFile="motor_control_interface.h")
  u16_ampDycAmp: dt_DutyCycl_u16p15b0  % Duty cycle amplitude
  u16_phiActElecAg: dt_RadAng_u16r15b0  % Electric angle
  u16_phiDaxQaxVltgAg: dt_RadAng_u16r15b0  % Voltage angle
  enm_stMotoSt: Enum: ENM_MOTO_STATUS  % Motor status
  s16_nPredActElecSpd: dt_Standardize_s16p15b0  % Predicted electric speed
  bol_enPosSCDCalibEnFlg: boolean  % Predicted electric speed

BUS_DCYCGEN_FST_TASK_OUT_SENLVRNT = Simulink.Bus(DataScope="Exported", HeaderFile="motor_control_interface.h")
  u16_dcycPhDyc: dt_DutyCycl_u16p15b0[3]  % Duty cycle for XYZ phases
  u16_ampMaxNrmVltgAmp: dt_DutyCycl_u16p15b0  % Maximum normalized voltage amplitude
  u16_phiModulActElecAg: dt_RadAng_u16r15b0  % Estimated electric angle

BUS_PHVLTGGEN_MED_TASK_IN_SENLVRNT = Simulink.Bus()
  s16_iRefDaxQaxCurr: dt_Standardize_s16p15b0[2]  % Reference Direct and Quadrature curents
  s16_iActPhCurr: dt_Standardize_s16p15b0[3]  % Actual Direct and Quadrature curents
  u16_phiSensActElecAg: dt_RadAng_u16r15b0  % Actual Direct and Quadrature curents
  u16_uSplyVltg: dt_Standardize_u16p15b0  % Supply DC voltage
  enm_stMotoSt: Enum: ENM_MOTO_STATUS  % Motor status
  u16_phiModulActElecAg: dt_RadAng_u16r15b0  % Estimated electric angle
  u16_dcycPhDyc: dt_DutyCycl_u16p15b0[3]
  s16_nRmpRefElecSpd: dt_Standardize_s16p15b0
  u16_ampMaxVltgAmp: dt_Standardize_u16p15b0  % Reference electric angle in align state
  s16_uRefDaxVltgLim: dt_Standardize_s16p15b0  % Reference electric angle in align state
  s16_uRefQaxVltgLim: dt_Standardize_s16p15b0  % Reference electric angle in align state

BUS_PHVLTGGEN_MED_TASK_IN_SENSVRNT = Simulink.Bus(DataScope="Exported", HeaderFile="motor_control_interface.h")
  s16_iRefDaxQaxCurr: dt_Standardize_s16p15b0[2]  % Reference Direct and Quadrature curents
  s16_iActPhCurr: dt_Standardize_s16p15b0[3]  % Actual Direct and Quadrature curents
  u16_phiSensActElecAg: dt_RadAng_u16r15b0  % Measured rotor angle by the GMR sensor
  u16_uSplyVltg: dt_Standardize_u16p15b0  % Supply DC voltage
  enm_stMotoSt: Enum: ENM_MOTO_STATUS  % Motor status
  u16_phiModulActElecAg: dt_RadAng_u16r15b0  % Estimated electric angle
  u16_phiPosSCDCalibElecAg: dt_RadAng_u16r15b0  % Reference electric angle in align state
  u16_dcycPhDyc: dt_DutyCycl_u16p15b0[3]  % Reference electric angle in align state
  bol_enPosSCDCalibEnFlg: boolean  % Reference electric angle in align state
  s16_nRmpRefElecSpd: dt_Standardize_s16p15b0  % Reference electric angle in align state
  u16_ampMaxVltgAmp: dt_Standardize_u16p15b0  % Reference electric angle in align state
  s16_uRefDaxVltgLim: dt_Standardize_s16p15b0  % Reference electric angle in align state
  s16_uRefQaxVltgLim: dt_Standardize_s16p15b0  % Reference electric angle in align state

BUS_PHVLTGGEN_MED_TASK_OUT_SENSVRNT = Simulink.Bus(DataScope="Exported", HeaderFile="motor_control_interface.h")
  u16_ampDycAmp: dt_DutyCycl_u16p15b0  % Duty cycle amplitude
  u16_phiDaxQaxVltgAg: dt_RadAng_u16r15b0  % Voltage angle
  u16_phiActElecAg: dt_RadAng_u16r15b0  % Actual electric angle after choice
  s16_nActElecSpd: dt_Standardize_s16p15b0  % Actual electric speed
  s16_iActDaxQaxCurr: dt_Standardize_s16p15b0[2]  % Actual Direct and Quadrature current
  s16_nPredActElecSpd: dt_Standardize_s16p15b0  % Predicted electric speed
  s16_uModulDaxQaxVltg: dt_Standardize_s16p15b0[2]  % Reference Direct and Quadrature currents
  s16_uRefDaxVltg: dt_Standardize_s16p15b0  % Actual electric angle after choice

BUS_PHCURRGEN_SLW_TASK_OUT_HYBRVRNT = Simulink.Bus()
  iRefDQCurr: dt_ElctCurr_s16p7b0[2]  % Reference Direct and Quadrature currents
  iEstSplyCurr: dt_ElctCurr_s16p7b0  % Estimated DC supply current
  iActLineCurr: dt_ElctCurr_s16p7b0  % Actual line current
  bolDrtnFlag: boolean  % Dreating active flag
  bolStrtUpProcOk: boolean
  wRefElctSpd: dt_RpsElctSpd_s16p3b0
  iCalibCurr: dt_ElctCurr_s16p7b0
  arCalibElecAng: dt_RadAng_u16r15b0
  bolCalibSuccFlag: boolean
  arSensErrMechAng: dt_SensAng_uint16
  AngSensCalib_Status: Enum:ANGSENSCALIB_STATUS
  mtrAlgPermFail: boolean

BUS_PHCURRGEN_SLW_TASK_OUT_SENSVRNT = Simulink.Bus(DataScope="Exported", HeaderFile="motor_control_interface.h")
  s16_iRefDaxQaxCurr: dt_Standardize_s16p15b0[2]  % Reference Direct and Quadrature currents
  enm_stMotoSt: Enum: ENM_MOTO_STATUS  % enmMotStas

Cdbl_numGDVltgMAFSmpNum = Simulink.Parameter(40, DataType="double")

BUS_SIGIN_SLW_TASK_OUT_SENSVRNT = Simulink.Bus(DataScope="Exported", HeaderFile="motor_control_interface.h")
  u16_uSplyVltg: dt_Standardize_u16p15b0  % Reference Direct and Quadrature curents
  u16_uCtlBrdVltg: dt_Standardize_u16p15b0  % Reference Direct and Quadrature curents
  u16_uGDVltg: dt_Standardize_u16p15b0  % Reference Direct and Quadrature curents
  u8_tPwrTubTemp: dt_Temp_u8p0bn40  % Reference Direct and Quadrature curents
  u8_tPCBTemp: dt_Temp_u8p0bn40  % Reference Direct and Quadrature curents
  u8_tMotoTemp: dt_Temp_u8p0bn40  % Reference Direct and Quadrature curents

Cdbl_stDSMSaveInfoSt = Simulink.Parameter(1, DataType="double")
Cdbl_numComFramLosSmpNum = Simulink.Parameter(10, DataType="double")
Cdbl_numDataExcdLimSmpNum = Simulink.Parameter(10, DataType="double")
Cdbl_facSpdCtlKpMaxVal = Simulink.Parameter(8, DataType="double")

BUS_PHVLTGGEN_MED_TASK_OUT_SENLVRNT = Simulink.Bus()
  u16_ampDycAmp: dt_DutyCycl_u16p15b0  % Duty cycle amplitude
  u16_phiDaxQaxVltgAg: dt_RadAng_u16r15b0  % Voltage angle
  u16_phiActElecAg: dt_RadAng_u16r15b0  % Actual electric angle
  s16_nActElecSpd: dt_Standardize_s16p15b0  % Actual electric speed
  s16_iActDaxQaxCurr: dt_Standardize_s16p15b0[2]  % Actual Direct and Quadrature current
  s16_nPredActElecSpd: dt_Standardize_s16p15b0  % Predicted electric speed
  s16_uModulDaxQaxVltg: dt_Standardize_s16p15b0[2]  % Reference Direct and Quadrature currents
  s16_uRefDaxVltg: dt_Standardize_s16p15b0
  u16_phiSenlElecAgSensElecAgDvt: dt_RadAng_u16r15b0
  u16_psiEstPermMagFlx: dt_MagFlux_u16p22b0

BUS_AST_SLW_TASK_OUT_SENSVRNT = Simulink.Bus(DataScope="Exported", HeaderFile="motor_control_interface.h")
  s16_iEstSplyCurr: dt_Standardize_s16p15b0  % Estimated DC supply current
  s16_ampActPhCurrAmp: dt_Standardize_s16p15b0  % Actual line current
  s16_trqPosSCDCalibRefTq: dt_Standardize_s16p15b0  % Reference current in align state
  u16_phiPosSCDCalibElecAg: dt_RadAng_u16r15b0  % Reference electric angle in align state
  bol_flgPosSCDCalibSucFlg: boolean  % Judge whether calibration is successful
  u16_ADSensMechAgDvt: uint16  % mechanical angle error
  enm_stPosSCDCalibSt: Enum: ENM_AG_SENS_CALIB_STATUS  % Align state
  bol_flgPosSCDCalibPermFail: boolean  % Align fail
  s16_trqRefTqLim: dt_Standardize_s16p15b0  % Align fail
  s16_nRmpRefElecSpd: dt_Standardize_s16p15b0  % Align fail
  bol_flgShOffFlg: boolean
  s16_nRefElecSpd: dt_Standardize_s16p15b0
  enm_stSysSt: Enum: ENM_SYS_STATUS
  u16_ampMaxVltgAmp: dt_Standardize_u16p15b0
  s16_uRefDaxVltgLim: dt_Standardize_s16p15b0
  s16_uRefQaxVltgLim: dt_Standardize_s16p15b0
  s16_pwrSplyElecPwr: dt_Standardize_s16p15b0

BUS_AST_SLW_TASK_OUT_SENLVRNT = Simulink.Bus(DataScope="Exported", HeaderFile="motor_control_interface.h")
  s16_iEstSplyCurr: dt_Standardize_s16p15b0  % Estimated DC supply current
  s16_ampActPhCurrAmp: dt_Standardize_s16p15b0  % Actual line current
  s16_trqRefTqLim: dt_Standardize_s16p15b0  % Align fail
  s16_nRmpRefElecSpd: dt_Standardize_s16p15b0  % Align fail
  bol_flgShOffFlg: boolean
  s16_nRefElecSpd: dt_Standardize_s16p15b0
  enm_stSysSt: Enum: ENM_SYS_STATUS
  u16_ampMaxVltgAmp: dt_Standardize_u16p15b0
  s16_uRefDaxVltgLim: dt_Standardize_s16p15b0
  s16_uRefQaxVltgLim: dt_Standardize_s16p15b0
  s16_pwrSplyElecPwr: dt_Standardize_s16p15b0

BUS_PHCURRGEN_SLW_TASK_IN_SENSVRNT = Simulink.Bus(DataScope="Exported", HeaderFile="motor_control_interface.h")
  s16_nRefElecSpd: dt_Standardize_s16p15b0  % Reference mechanical speed in RPM
  s16_nActElecSpd: dt_Standardize_s16p15b0  % Actual electric speed in rad/s
  s16_nRmpRefElecSpd: dt_Standardize_s16p15b0  % Permanent magnetic flux
  s16_trqRefTqLim: dt_Standardize_s16p15b0  % DC supply current limit for derating provided by BSW
  bol_flgShOffFlg: boolean
  bol_enPosSCDCalibEnFlg: boolean
  s16_trqPosSCDCalibRefTq: dt_Standardize_s16p15b0  % Reference Direct and Quadrature currents

BUS_PHCURRGEN_SLW_TASK_IN_SENLVRNT = Simulink.Bus(DataScope="Exported", HeaderFile="motor_control_interface.h")
  s16_nRefElecSpd: dt_Standardize_s16p15b0  % Reference mechanical speed in RPM
  s16_nActElecSpd: dt_Standardize_s16p15b0  % Actual electric speed in rad/s
  s16_nRmpRefElecSpd: dt_Standardize_s16p15b0  % Permanent magnetic flux
  s16_trqRefTqLim: dt_Standardize_s16p15b0  % DC supply current limit for derating provided by BSW
  bol_flgShOffFlg: boolean

BUS_AST_SLW_TASK_IN_SENSVRNT = Simulink.Bus(DataScope="Exported", HeaderFile="motor_control_interface.h")
  s16_nComRefMechSpd: dt_Standardize_s16p15b0  % Reference mechanical speed in RPM
  s16_nActElecSpd: dt_Standardize_s16p15b0  % Actual electric speed in rad/s
  s16_uModulDaxQaxVltg: dt_Standardize_s16p15b0[2]
  u16_uSplyVltg: dt_Standardize_u16p15b0
  s16_iActDaxQaxCurr: dt_Standardize_s16p15b0[2]
  enm_stMotoSt: Enum: ENM_MOTO_STATUS  % Actual electric angle
  bol_enPosSCDCalibEnFlg: boolean  % Actual electric angle
  u16_phiSensActElecAg: dt_RadAng_u16r15b0  % Measured rotor angle by the GMR sensor
  u8_stMaxFaltLvl: uint8  % Measured rotor angle by the GMR sensor
  busOBD_FaltSt: Bus: BUS_OBD_FALT_STS  % Measured rotor angle by the GMR sensor
  s16_nFaltRefMechSpd: dt_Standardize_s16p15b0  % Measured rotor angle by the GMR sensor
  s16_trqFaltRefTqLim: dt_Standardize_s16p15b0  % Measured rotor angle by the GMR sensor
  bol_flgComTurnOnFlg: boolean  % Measured rotor angle by the GMR sensor
  bol_flgComWakeUpFlg: boolean  % Measured rotor angle by the GMR sensor
  bol_flgComSlepFlg: boolean  % Measured rotor angle by the GMR sensor
  bol_flgComLmpHmeFlg: boolean  % Measured rotor angle by the GMR sensor
  u8_tPCBTemp: dt_Temp_u8p0bn40  % Measured rotor angle by the GMR sensor
  u16_ampMaxNrmVltgAmp: dt_DutyCycl_u16p15b0
  s16_uRefDaxVltg: dt_Standardize_s16p15b0
  bol_flgOvrTstCtlUDS2F: boolean

BUS_AST_SLW_TASK_IN_SENLVRNT = Simulink.Bus(DataScope="Exported", HeaderFile="motor_control_interface.h")
  s16_nComRefMechSpd: dt_Standardize_s16p15b0  % Reference mechanical speed in RPM
  s16_nActElecSpd: dt_Standardize_s16p15b0  % Actual electric speed in rad/s
  s16_uModulDaxQaxVltg: dt_Standardize_s16p15b0[2]
  u16_uSplyVltg: dt_Standardize_u16p15b0
  s16_iActDaxQaxCurr: dt_Standardize_s16p15b0[2]
  enm_stMotoSt: Enum: ENM_MOTO_STATUS  % Actual electric angle
  u8_stMaxFaltLvl: uint8  % Measured rotor angle by the GMR sensor
  busOBD_FaltSt: Bus: BUS_OBD_FALT_STS  % Measured rotor angle by the GMR sensor
  s16_nFaltRefMechSpd: dt_Standardize_s16p15b0  % Measured rotor angle by the GMR sensor
  s16_trqFaltRefTqLim: dt_Standardize_s16p15b0  % Measured rotor angle by the GMR sensor
  bol_flgComTurnOnFlg: boolean  % Measured rotor angle by the GMR sensor
  bol_flgComWakeUpFlg: boolean  % Measured rotor angle by the GMR sensor
  bol_flgComSlepFlg: boolean  % Measured rotor angle by the GMR sensor
  bol_flgComLmpHmeFlg: boolean  % Measured rotor angle by the GMR sensor
  u8_tPCBTemp: dt_Temp_u8p0bn40  % Measured rotor angle by the GMR sensor
  u16_ampMaxNrmVltgAmp: dt_DutyCycl_u16p15b0
  s16_uRefDaxVltg: dt_Standardize_s16p15b0
  bol_flgOvrTstCtlUDS2F: boolean

BUS_SIGIN_MED_TASK_OUT_SENLVRNT = Simulink.Bus(DataScope="Exported", HeaderFile="motor_control_interface.h")
  s16_iActPhCurr: dt_Standardize_s16p15b0[3]  % Duty cycle amplitude

BUS_SIGIN_MED_TASK_IN_SENLVRNT = Simulink.Bus(DataScope="Exported", HeaderFile="motor_control_interface.h")
  s16_uADActPhCurr: uint16[3]  % Reference Direct and Quadrature curents
  s16_uADActPhCurrOfs: uint16  % Reference Direct and Quadrature curents
  u8_numSectNum: uint8

BUS_OBD_SLW_TASK_IN_SENSVRNT = Simulink.Bus(DataScope="Exported", HeaderFile="motor_control_interface.h")
  s16_nRmpRefElecSpd: dt_Standardize_s16p15b0
  s16_nActElecSpd: dt_Standardize_s16p15b0  % Actual electric speed in rad/s
  enm_stMotoSt: Enum: ENM_MOTO_STATUS  % Actual electric angle
  s16_ampActPhCurrAmp: dt_Standardize_s16p15b0  % Actual electric angle
  u16_uSplyVltg: dt_Standardize_u16p15b0  % Actual electric angle
  u8_tPwrTubTemp: dt_Temp_u8p0bn40  % Actual electric angle
  u8_tPCBTemp: dt_Temp_u8p0bn40  % Actual electric angle
  u8_tMotoTemp: dt_Temp_u8p0bn40  % Actual electric angle
  bol_flgComLosFaltRaw: boolean  % Actual electric angle
  bol_ctComRolCnt: uint8  % Actual electric angle
  u16_uCtlBrdVltg: dt_Standardize_u16p15b0  % Actual electric angle
  enm_stSysSt: Enum: ENM_SYS_STATUS
  bol_flgHWOvrCurrFalt: boolean
  u16_uGDVltg: dt_Standardize_u16p15b0
  bol_flgChipFalt: boolean
  bol_flgPhiSensFalt: boolean
  s16_uADActPhCurr: uint16[3]
  u16_uADPwrTubTemp: uint16
  u16_uADPCBTemp: uint16
  u16_uADMotoTemp: uint16
  s16_pwrSplyElecPwr: dt_Standardize_s16p15b0
  s16_iActPhCurr: dt_Standardize_s16p15b0[3]
  s16_iEstSplyCurr: dt_Standardize_s16p15b0
  s16_iRefDaxQaxCurr: dt_Standardize_s16p15b0[2]
  s16_iActDaxQaxCurr: dt_Standardize_s16p15b0[2]
  bol_flgShOffFlg: boolean
  bol_enFaltInfoClrUDS14: boolean
  s16_vVehSpd: int16
  u32_disOde: uint32
  u32_tiStamHi: uint32
  u32_tiStamLo: uint32
  u8_psiOilFlow: uint8
  u8_tOilTemp: dt_Temp_u8p0bn40
  bol_enPosSCDCalibEnFlg: boolean
  u8_psiUpLimOilFlow: uint8
  bol_flgBusOffFaltRaw: boolean
  bol_flgFaltEnFlgUDS85: boolean
  bol_flgWBSSt: boolean
  bol_flgCRCFaltRaw: boolean
  bol_flgMesgLngthFaltRaw: boolean
  s16_nComRefMechSpd: dt_Standardize_s16p15b0

Cdbl_facVltgIntegFltCoeffMaxVal = Simulink.Parameter(0.1, DataType="double")
Cdbl_psiVltgIntegMaxVal = Simulink.Parameter(0.2, DataType="double")
Cdbl_psiPermMagFlxMaxVal = Simulink.Parameter(0.33332, DataType="double")
Cdbl_psiPermMagFlxMinVal = Simulink.Parameter(0.00167, DataType="double")
Cdbl_psiPermMagFlxPeakVal = Simulink.Parameter(0.06, DataType="double")
Cdbl_facPLLCtlKpMaxVal = Simulink.Parameter(1000, DataType="double")
Cdbl_facPLLCtlKiMaxVal = Simulink.Parameter(1000, DataType="double")
Cdbl_indPhIndcPeakVal = Simulink.Parameter(0.0002, DataType="double")
Cdbl_indPhIndcMaxVal = Simulink.Parameter(0.5, DataType="double")
Cdbl_resPhRstnMaxVal = Simulink.Parameter(0.5, DataType="double")
Cdbl_resPhRstnPeakVal = Simulink.Parameter(0.2, DataType="double")
Cdbl_tiSlwTaskSmpTi = Simulink.Parameter(0.01, DataType="fixdt(0,16,2^-22,0)")  % fixdt(0,16,2^-22,0)
Cdbl_tiMedTaskSmpTi = Simulink.Parameter(0.0005, DataType="fixdt(0,16,2^-26,0)")  % fixdt(0,16,2^-26,0)
Cdbl_modeSysState = Simulink.Parameter(ENM_SYS_STATUS_MODE.JEELY, DataType="Enum: ENM_SYS_STATUS_MODE")
Cdbl_tNTCMCUTempDvtMaxVal = Simulink.Parameter(70, DataType="double")

BUS_DCYCGEN_FST_TASK_OUT_SENSVRNT = Simulink.Bus(DataScope="Exported", HeaderFile="motor_control_interface.h")
  u16_dcycPhDyc: dt_DutyCycl_u16p15b0[3], Min=0, Max=1  % Duty cycle for XYZ phases
  u16_ampMaxNrmVltgAmp: dt_DutyCycl_u16p15b0, Min=0, Max=0.99997  % Maximum normalized voltage amplitude
  u16_phiModulActElecAg: dt_RadAng_u16r15b0, Min=0, Max=6.28309  % Estimated electric angle

BUS_PHCURRGEN_SLW_TASK_OUT_SENLVRNT = Simulink.Bus()
  s16_iRefDaxQaxCurr: dt_Standardize_s16p15b0[2], Min=-0.99997, Max=0.99997  % Reference Direct and Quadrature currents
  enm_stMotoSt: Enum: ENM_MOTO_STATUS  % enmMotStas

Cdbl_numFaltDiaNum = 30
Cdbl_numCtlBrdVltgHiLvl1 = Simulink.Parameter(ENM_TYPE_FALT.CTL_BRD_VLTG_HI_LVL1, DataType="Enum: ENM_TYPE_FALT")
Cdbl_tiFstTaskSmpTi = Simulink.Parameter(0.000125, DataType="fixdt(0,16,2^-28,0)")  % fixdt(0,16,2^-28,0)

BUS_PHVLTGGEN_MED_TASK_IN_HYBRVRNT = Simulink.Bus()
  s16_iRefDaxQaxCurr: dt_Standardize_s16p15b0[2]  % Reference Direct and Quadrature curents
  s16_iActPhCurr: dt_Standardize_s16p15b0[3]  % Actual Direct and Quadrature curents
  u16_phiSensActElecAg: dt_RadAng_u16r15b0  % Actual Direct and Quadrature curents
  u16_uSplyVltg: dt_Standardize_u16p15b0  % Supply DC voltage
  enm_stMotoSt: Enum: ENM_MOTO_STATUS  % Motor status
  u16_phiModulActElecAg: dt_RadAng_u16r15b0  % Estimated electric angle
  u16_phiPosSCDCalibElecAg: dt_RadAng_u16r15b0  % Reference electric angle in align state
  u16_dcycPhDyc: dt_DutyCycl_u16p15b0[3]
  bol_enPosSCDCalibEnFlg: boolean  % Reference electric angle in align state
  enm_modeAgEvalMode: Enum: ENM_AG_POS_EVAL_MODE  % Reference electric angle in align state
  s16_nRmpRefElecSpd: dt_Standardize_s16p15b0
  u8_tPCBTempSubs: dt_Temp_u8p0bn40  % Reference electric angle in align state
  u16_ampMaxNrmVltgAmp: dt_DutyCycl_u16p15b0

BUS_AST_SLW_TASK_IN_HYBRVRNT = Simulink.Bus(DataScope="Exported", HeaderFile="motor_control_interface.h")
  s16_nComRefMechSpd: dt_Standardize_s16p15b0  % Reference mechanical speed in RPM
  s16_nActElecSpd: dt_Standardize_s16p15b0  % Actual electric speed in rad/s
  s16_uModulDaxQaxVltg: dt_Standardize_s16p15b0[2]
  u16_uSplyVltg: dt_Standardize_u16p15b0
  s16_iActDaxQaxCurr: dt_Standardize_s16p15b0[2]
  enm_stMotoSt: Enum: ENM_MOTO_STATUS  % Actual electric angle
  bol_enPosSCDCalibEnFlg: boolean  % Actual electric angle
  u16_phiSensActElecAg: dt_RadAng_u16r15b0  % Measured rotor angle by the GMR sensor
  u8_stMaxFaltLvl: uint8  % Measured rotor angle by the GMR sensor
  busOBD_FaltSt: Bus: BUS_OBD_FALT_STS  % Measured rotor angle by the GMR sensor
  s16_nFaltRefMechSpd: dt_Standardize_s16p15b0  % Measured rotor angle by the GMR sensor
  s16_trqFaltRefTqLim: dt_Standardize_s16p15b0  % Measured rotor angle by the GMR sensor
  u8_modeMCUOpMode: uint8  % Measured rotor angle by the GMR sensor
  u8_tPCBTempSubs: dt_Temp_u8p0bn40  % Measured rotor angle by the GMR sensor
  bol_flgOvrTstCtlUDS2F: boolean
  bol_flgPhiSensFaltRawFlg: boolean  % Reference Direct and Quadrature curents
  u8_FrzFrmSaveFlg: uint8  % Reference Direct and Quadrature curents
  bol_flgSlepEn: boolean  % Reference Direct and Quadrature curents

BUS_SIGIN_MED_TASK_OUT_SENSVRNT = Simulink.Bus(DataScope="Exported", HeaderFile="motor_control_interface.h")
  u16_phiSensActElecAg: dt_RadAng_u16r15b0, Min=0, Max=6.28299356  % Duty cycle amplitude
  s16_iActPhCurr: dt_Standardize_s16p15b0[3], Min=-0.99997, Max=0.99997  % Duty cycle amplitude
  u16_uSplyVltg: dt_Standardize_u16p15b0, Min=0, Max=0.99997  % Reference Direct and Quadrature curents

BUS_SIGIN_SLW_TASK_OUT_SENLVRNT = Simulink.Bus(DataScope="Exported", HeaderFile="motor_control_interface.h")
  u16_uCtlBrdVltg: dt_Standardize_u16p15b0, Min=0, Max=0.99997  % Reference Direct and Quadrature curents
  u16_uGDVltg: dt_Standardize_u16p15b0, Min=0, Max=0.99997  % Reference Direct and Quadrature curents
  u8_tPwrTubTemp: dt_Temp_u8p0bn40, Min=-40, Max=215  % Reference Direct and Quadrature curents
  u8_tPCBTemp: dt_Temp_u8p0bn40, Min=-40, Max=215  % Reference Direct and Quadrature curents
  u8_tMotoTemp: dt_Temp_u8p0bn40, Min=-40, Max=215  % Reference Direct and Quadrature curents
  u8_tPCBTempSubs: dt_Temp_u8p0bn40, Min=-40, Max=215  % Reference Direct and Quadrature curents

BUS_PHCURRGEN_SLW_TASK_IN_HYBRVRNT = Simulink.Bus(DataScope="Exported", HeaderFile="motor_control_interface.h")
  s16_nRefElecSpd: dt_Standardize_s16p15b0  % Reference mechanical speed in RPM
  s16_nActElecSpd: dt_Standardize_s16p15b0  % Actual electric speed in rad/s
  s16_nRmpRefElecSpd: dt_Standardize_s16p15b0  % Permanent magnetic flux
  s16_trqRefTqLim: dt_Standardize_s16p15b0  % DC supply current limit for derating provided by BSW
  bol_flgShOffFlg: boolean
  bol_enPosSCDCalibEnFlg: boolean
  s16_trqPosSCDCalibRefTq: dt_Standardize_s16p15b0  % Reference Direct and Quadrature currents
  enm_modeAgEvalMode: Enum: ENM_AG_POS_EVAL_MODE  % Reference Direct and Quadrature currents
  s16_phiOpnLpAgClsLpAgDvt: dt_RadAng_s16r15b0  % Reference Direct and Quadrature currents

BUS_AST_SLW_TASK_OUT_HYBRVRNT = Simulink.Bus(DataScope="Exported", HeaderFile="motor_control_interface.h")
  s16_iEstSplyCurr: dt_Standardize_s16p15b0, Min=-0.99997, Max=0.99997  % Estimated DC supply current
  s16_ampActPhCurrAmp: dt_Standardize_s16p15b0, Min=-0.99997, Max=0.99997  % Actual line current
  s16_trqPosSCDCalibRefTq: dt_Standardize_s16p15b0, Min=-0.99997, Max=0.99997  % Reference current in align state
  u16_phiPosSCDCalibElecAg: dt_RadAng_u16r15b0, Min=0, Max=6.28309  % Reference electric angle in align state
  bol_flgPosSCDCalibSucFlg: boolean, Min=0, Max=1  % Judge whether calibration is successful
  u16_ADSensMechAgDvt: uint16, Min=0, Max=65535  % mechanical angle error
  enm_stPosSCDCalibSt: Enum: ENM_AG_SENS_CALIB_STATUS  % Align state
  bol_flgPosSCDCalibPermFail: boolean, Min=0, Max=1  % Align fail
  s16_trqRefTqLim: dt_Standardize_s16p15b0, Min=-0.99997, Max=0.99997  % Align fail
  s16_nRmpRefElecSpd: dt_Standardize_s16p15b0, Min=-0.99997, Max=0.99997  % Align fail
  bol_flgShOffFlg: boolean, Min=0, Max=1
  s16_nRefElecSpd: dt_Standardize_s16p15b0, Min=-0.99997, Max=0.99997
  enm_stSysSt: Enum: ENM_SYS_STATUS
  s16_pwrSplyElecPwr: dt_Standardize_s16p15b0, Min=-0.99997, Max=0.99997
  enm_modeAgEvalMode: Enum: ENM_AG_POS_EVAL_MODE
  u16_phiSensElecAgDvt: dt_RadAng_u16r15b0
  s16_nActElecSpdComFlt: dt_Standardize_s16p15b0

BUS_SIGIN_MED_TASK_IN_SENSVRNT = Simulink.Bus(DataScope="Exported", HeaderFile="motor_control_interface.h")
  u16_ADSensActMechAg: uint16  % Reference Direct and Quadrature curents
  u16_uADActPhCurr: uint16[3]  % Reference Direct and Quadrature curents
  u16_uADActPhCurrOfs: uint16  % Reference Direct and Quadrature curents
  u8_numSectNum: uint8
  u16_uADSplyVltg: uint16  % Reference Direct and Quadrature curents
  u16_phiDvtSensElecAg: dt_RadAng_u16r15b0  % Reference Direct and Quadrature curents
  bol_enPosSCDCalibEnFlg: boolean  % Reference Direct and Quadrature curents

BUS_OBD_SLW_TASK_OUT_HYBRVRNT = Simulink.Bus(DataScope="Exported", HeaderFile="motor_control_interface.h")
  busOBD_FaltSt: Bus: BUS_OBD_FALT_STS
  u8_stMaxFaltLvl: uint8, Min=0, Max=255  % Reference Direct and Quadrature curents
  s16_nFaltRefMechSpd: dt_Standardize_s16p15b0, Min=-0.99997, Max=0.99997  % Reference Direct and Quadrature curents
  s16_trqFaltRefTqLim: dt_Standardize_s16p15b0, Min=-0.99997, Max=0.99997  % Reference Direct and Quadrature curents
  bol_flgPhiSensFaltRawFlg: boolean, Min=0, Max=1  % Reference Direct and Quadrature curents
  bol_flgComNodeLosFaltDeb: boolean, Min=0, Max=1  % Reference Direct and Quadrature curents
  bol_flgComRolCntFaltDeb: boolean, Min=0, Max=1  % Reference Direct and Quadrature curents
  bol_flgCRCFaltDeb: boolean, Min=0, Max=1  % Reference Direct and Quadrature curents
  busOBD_FaltStTmp: Bus: BUS_OBD_FALT_STS_TMP

BUS_PHVLTGGEN_MED_TASK_OUT_HYBRVRNT = Simulink.Bus()
  u16_ampDycAmp: dt_DutyCycl_u16p15b0, Min=0, Max=1  % Duty cycle amplitude
  u16_phiDaxQaxVltgAg: dt_RadAng_u16r15b0, Min=0, Max=6.28309  % Voltage angle
  u16_phiActElecAg: dt_RadAng_u16r15b0, Min=0, Max=6.28309  % Actual electric angle
  s16_nActElecSpd: dt_Standardize_s16p15b0, Min=-0.99997, Max=0.99997  % Actual electric speed
  s16_iActDaxQaxCurr: dt_Standardize_s16p15b0[2], Min=-0.99997, Max=0.99997  % Actual Direct and Quadrature current
  s16_nPredActElecSpd: dt_Standardize_s16p15b0, Min=-0.99997, Max=0.99997  % Predicted electric speed
  s16_uModulDaxQaxVltg: dt_Standardize_s16p15b0[2], Min=-0.99997, Max=0.99997  % Reference Direct and Quadrature currents
  u16_phiSenlElecAgSensElecAgDvt: dt_RadAng_u16r15b0, Min=0, Max=6.28309
  u16_psiEstPermMagFlx: dt_Standardize_u16p15b0, Min=0, Max=0.99997
  s16_phiOpnLpAgClsLpAgDvt: dt_RadAng_s16r15b0, Min=-3.14154, Max=3.14154

BUS_OBD_SLW_TASK_IN_SENLVRNT = Simulink.Bus(DataScope="Exported", HeaderFile="motor_control_interface.h")
  s16_nRmpRefElecSpd: dt_Standardize_s16p15b0
  s16_nActElecSpd: dt_Standardize_s16p15b0  % Actual electric speed in rad/s
  enm_stMotoSt: Enum: ENM_MOTO_STATUS  % Actual electric angle
  s16_ampActPhCurrAmp: dt_Standardize_s16p15b0  % Actual electric angle
  u16_uSplyVltg: dt_Standardize_u16p15b0  % Actual electric angle
  u8_tPwrTubTemp: dt_Temp_u8p0bn40  % Actual electric angle
  u8_tPCBTemp: dt_Temp_u8p0bn40  % Actual electric angle
  u8_tMotoTemp: dt_Temp_u8p0bn40  % Actual electric angle
  bol_flgComLosFaltRaw: boolean  % Actual electric angle
  bol_ctComRolCnt: uint8  % Actual electric angle
  u16_uCtlBrdVltg: dt_Standardize_u16p15b0  % Actual electric angle
  enm_stSysSt: Enum: ENM_SYS_STATUS
  bol_flgHWOvrCurrFalt: boolean
  u16_uGDVltg: dt_Standardize_u16p15b0
  bol_flgChipFalt: boolean
  s16_uADActPhCurr: uint16[3]
  u16_uADPwrTubTemp: uint16
  u16_uADPCBTemp: uint16
  u16_uADMotoTemp: uint16
  s16_pwrSplyElecPwr: dt_Standardize_s16p15b0
  s16_iActPhCurr: dt_Standardize_s16p15b0[3]
  s16_iEstSplyCurr: dt_Standardize_s16p15b0
  s16_iRefDaxQaxCurr: dt_Standardize_s16p15b0[2]
  s16_iActDaxQaxCurr: dt_Standardize_s16p15b0[2]
  bol_flgShOffFlg: boolean
  bol_enFaltInfoClrUDS14: boolean
  s16_vVehSpd: int16
  u32_disOde: uint32
  u32_tiStamHi: uint32
  u32_tiStamLo: uint32
  u8_psiOilFlow: uint8
  u8_tOilTemp: dt_Temp_u8p0bn40
  bol_enPosSCDCalibEnFlg: boolean
  u8_psiUpLimOilFlow: uint8
  bol_flgBusOffFaltRaw: boolean
  bol_flgFaltEnFlgUDS85: boolean
  bol_flgWBSSt: boolean
  bol_flgCRCFaltRaw: boolean
  bol_flgMesgLngthFaltRaw: boolean
  s16_nComRefMechSpd: dt_Standardize_s16p15b0
  u16_psiEstPermMagFlx: dt_MagFlux_u16p22b0
  bol_ComIf_flgComLosFaltRaw: boolean

BUS_OBD_SLW_TASK_IN_HYBRVRNT = Simulink.Bus(DataScope="Exported", HeaderFile="motor_control_interface.h")
  s16_nRmpRefElecSpd: dt_Standardize_s16p15b0
  s16_nActElecSpd: dt_Standardize_s16p15b0  % Actual electric speed in rad/s
  enm_stMotoSt: Enum: ENM_MOTO_STATUS  % Actual electric angle
  s16_ampActPhCurrAmp: dt_Standardize_s16p15b0  % Actual electric angle
  u16_uSplyVltg: dt_Standardize_u16p15b0  % Actual electric angle
  u8_tPwrTubTemp: dt_Temp_u8p0bn40  % Actual electric angle
  u8_tPCBTemp: dt_Temp_u8p0bn40  % Actual electric angle
  u8_tMotoTemp: dt_Temp_u8p0bn40  % Actual electric angle
  u8_ctLossNoData: uint8  % Actual electric angle
  u8_ctComRolCnt: uint8  % Actual electric angle
  u16_uCtlBrdVltg: dt_Standardize_u16p15b0  % Actual electric angle
  enm_stSysSt: Enum: ENM_SYS_STATUS
  bol_flgHWOvrCurrFalt: boolean
  bol_flgChipFalt: boolean
  bol_flgPhiSensFalt: boolean
  u16_uADActPhCurr: uint16[3]
  u16_uADPwrTubTemp: uint16
  u16_uADPCBTemp: uint16
  u16_uADMotoTemp: uint16
  s16_pwrSplyElecPwr: dt_Standardize_s16p15b0
  s16_iActPhCurr: dt_Standardize_s16p15b0[3]
  s16_iEstSplyCurr: dt_Standardize_s16p15b0
  s16_iRefDaxQaxCurr: dt_Standardize_s16p15b0[2]
  s16_iActDaxQaxCurr: dt_Standardize_s16p15b0[2]
  bol_flgShOffFlg: boolean
  bol_enFaltInfoClrUDS14: boolean
  u16_vVehSpd: fixdt(0,16,10^-2,0)
  u32_disOde: fixdt(0,32,10^-1,0)
  u32_tiStamHi: uint32
  u32_tiStamLo: uint32
  u8_psiOilFlow: fixdt(0,8,5^-1,0)
  u8_tOilTemp: dt_Temp_u8p0bn40
  bol_enPosSCDCalibEnFlg: boolean
  u8_psiUpLimOilFlow: fixdt(0,8,5^-1,0)
  bol_flgBusOffFaltRaw: boolean
  bol_flgFaltEnFlgUDS85: boolean
  bol_flgWBSSt: boolean
  bol_flgCRCFaltRaw: boolean
  bol_flgMesgLngthFaltRaw: boolean
  s16_nComRefMechSpd: dt_Standardize_s16p15b0
  u16_psiEstPermMagFlx: dt_Standardize_u16p15b0
  enm_modeAgEvalMode: Enum: ENM_AG_POS_EVAL_MODE
  bol_flgCrashFalt: boolean
  bol_flgGDVltgHiLvl1: boolean
  bol_flgGDVltgLoLvl1: boolean
  u8_tMCUTemp: dt_Temp_u8p0bn40
  u8_tPCBTempSubs: dt_Temp_u8p0bn40
  u16_uGDVltg: dt_Standardize_u16p15b0
  bol_flgMosOpnCirFalt: boolean