% Simulink data dictionary dd_foc_data_type.sldd

dt_DutyCycl_u16p15b0 = Simulink.NumericType(DataTypeMode="Fixed-point: slope and bias scaling", SignednessBool=false, WordLength=16, FixedExponent=-15, DataScope="Exported", HeaderFile="custom_type_definition.h")
dt_RadAng_u16r15b0 = Simulink.NumericType(DataTypeMode="Fixed-point: slope and bias scaling", SignednessBool=false, WordLength=16, FixedExponent=-14, SlopeAdjustmentFactor=1.570796, DataScope="Exported", HeaderFile="custom_type_definition.h")
dt_MotIndc_u16p29b0 = Simulink.NumericType(DataTypeMode="Fixed-point: slope and bias scaling", SignednessBool=false, WordLength=16, FixedExponent=-29, DataScope="Exported", HeaderFile="custom_type_definition.h")
dt_MotRstn_u16p20b0 = Simulink.NumericType(DataTypeMode="Fixed-point: slope and bias scaling", SignednessBool=false, WordLength=16, FixedExponent=-20, DataScope="Exported", HeaderFile="custom_type_definition.h")
dt_OmodFact_u16p15b0 = Simulink.NumericType(DataTypeMode="Fixed-point: slope and bias scaling", SignednessBool=false, WordLength=16, FixedExponent=-15, DataScope="Exported", HeaderFile="custom_type_definition.h")
dt_Temp_u8p0bn40 = Simulink.NumericType(DataTypeMode="Fixed-point: slope and bias scaling", SignednessBool=false, WordLength=8, FixedExponent=0, Bias=-40, DataScope="Exported", HeaderFile="custom_type_definition.h")
dt_RadAngErr_s16r13b0 = Simulink.NumericType(DataTypeMode="Fixed-point: slope and bias scaling", SignednessBool=true, WordLength=16, FixedExponent=-12, SlopeAdjustmentFactor=1.570796, DataScope="Exported", HeaderFile="custom_type_definition.h")
dt_Standardize_s16p15b0 = Simulink.NumericType(DataTypeMode="Fixed-point: slope and bias scaling", SignednessBool=true, WordLength=16, FixedExponent=-15, DataScope="Exported", HeaderFile="custom_type_definition.h")
dt_Standardize_u16p15b0 = Simulink.NumericType(DataTypeMode="Fixed-point: slope and bias scaling", SignednessBool=false, WordLength=16, FixedExponent=-15, DataScope="Exported", HeaderFile="custom_type_definition.h")
dt_DoubleStandardize_s16p14b0 = Simulink.NumericType(DataTypeMode="Fixed-point: slope and bias scaling", SignednessBool=true, WordLength=16, FixedExponent=-14, DataScope="Exported", HeaderFile="custom_type_definition.h")
dt_RefSpdSlewRate_s16p12b0 = Simulink.NumericType(DataTypeMode="Fixed-point: slope and bias scaling", SignednessBool=true, WordLength=16, FixedExponent=-12, DataScope="Exported", HeaderFile="custom_type_definition.h")
dt_CurrCtrlIntgGain_u16p5b0 = Simulink.NumericType(DataTypeMode="Fixed-point: slope and bias scaling", SignednessBool=false, WordLength=16, FixedExponent=-5, DataScope="Exported", HeaderFile="custom_type_definition.h")

ENM_AG_POS_EVAL_MODE = enum(DataScope="Exported", HeaderFile="custom_type_definition.h", DefaultValue="SENSOR", StorageType="uint8")
  SENSOR = 0
  HYBRID = 1
  SENSORLESS = 2

ENM_MOTO_STATUS = enum(DataScope="Exported", HeaderFile="custom_type_definition.h", DefaultValue="OFF", StorageType="uint8")
  OFF = 0
  OPEN_LOOP = 1
  CLOSED_LOOP = 2

ENM_PH_CURR_SMP_MODE = enum(DataScope="Exported", HeaderFile="custom_type_definition.h", DefaultValue="SNGSHT_GRO", StorageType="uint8")
  SNGSHT_GRO = 1
  TWOSHT_PHA = 2
  THRSENS_PHA = 3

ENM_PWM_MODE = enum(DataScope="Exported", HeaderFile="custom_type_definition.h", DefaultValue="SPWM", StorageType="uint8")
  SPWM = 1
  S3APWM = 2
  SVPWM = 3
  DMINPWM = 4

sint8 = Simulink.AliasType(BaseType="int8")
sint16 = Simulink.AliasType(BaseType="int16")
sint32 = Simulink.AliasType(BaseType="int32")
dt_SpdCtrlPropGain_u16p12b0 = Simulink.NumericType(DataTypeMode="Fixed-point: slope and bias scaling", SignednessBool=false, WordLength=16, FixedExponent=-12, DataScope="Exported", HeaderFile="custom_type_definition.h")
dt_CurrCtrlPropGain_u16p15b0 = Simulink.NumericType(DataTypeMode="Fixed-point: slope and bias scaling", SignednessBool=false, WordLength=16, FixedExponent=-14, DataScope="Exported", HeaderFile="custom_type_definition.h")
dt_VltgRat_u16p22b0 = Simulink.NumericType(DataTypeMode="Fixed-point: slope and bias scaling", SignednessBool=false, WordLength=16, FixedExponent=-22, DataScope="Exported", HeaderFile="custom_type_definition.h")

BUS_OBD_DSM_SAVE_INFO = Simulink.Bus(DataScope="Exported", HeaderFile="motor_control_interface.h")
  EE_FrzFrmstDTCBit3: boolean[30]
  EE_FrzFrmstDTCBit7: boolean[30]  % Actual electric angle
  EE_FrzFrmRunTi: uint32[30]  % Actual electric angle
  EE_FrzFrmFaltNum: uint8[30]  % Actual electric angle
  EE_FrzFrmuSplyVltg: dt_Standardize_u16p15b0[30]  % Actual electric angle
  EE_FrzFrmiRefQaxCurr: dt_Standardize_s16p15b0[30]  % Actual electric angle
  EE_FrzFrmiActQaxCurr: dt_Standardize_s16p15b0[30]  % Actual electric angle
  EE_FrzFrmiEstSplyCurr: dt_Standardize_s16p15b0[30]  % Actual electric angle
  EE_FrzFrmnRmpRefElecSpd: dt_Standardize_s16p15b0[30]  % Actual electric angle
  EE_FrzFrmnActElecSpd: dt_Standardize_s16p15b0[30]  % Actual electric angle
  EE_FrzFrmuCtlBrdVltg: dt_Standardize_u16p15b0[30]  % Actual electric angle
  EE_FrzFrmstMotoSt: Enum: ENM_MOTO_STATUS[30]  % Actual electric angle
  EE_FrzFrmflgShOffFlg: boolean[30]  % Actual electric angle
  EE_FrzFrmtMotoTemp: dt_Temp_u8p0bn40[30]  % Actual electric angle
  EE_FrzFrmtPwrTubTemp: dt_Temp_u8p0bn40[30]  % Actual electric angle
  EE_FrzFrmtPCBTemp: dt_Temp_u8p0bn40[30]  % Actual electric angle
  EE_FrzFrmiActPhUCurr: dt_Standardize_s16p15b0[30]  % Actual electric angle
  EE_FrzFrmiActPhVCurr: dt_Standardize_s16p15b0[30]  % Actual electric angle
  EE_FrzFrmvVehSpd: fixdt(0,16,10^-2,0)[30]  % Actual electric angle
  EE_FrzFrmOde: fixdt(0,32,10^-1,0)[30]  % Actual electric angle
  EE_FrzFrmTiStamHi: uint32[30]  % Actual electric angle
  EE_FrzFrmTiStamLo: uint32[30]  % Actual electric angle
  EE_FrzFrmActOilFlow: fixdt(0,8,5^-1,0)[30]  % Actual electric angle
  EE_FrzFrmActOilTemp: dt_Temp_u8p0bn40[30]  % Actual electric angle
  EE_FrzFrmflgPhiCalibSuc: boolean[30]  % Actual electric angle
  EE_FrzFrmUpLimOilFlow: fixdt(0,8,5^-1,0)[30]  % Actual electric angle
  EE_FrzFrmHFRunTi: uint16[30]  % Actual electric angle
  EE_SystiRun: uint32  % Actual electric angle

ENM_SYS_STATUS_MODE = enum(DataScope="Exported", HeaderFile="custom_type_definition.h", DefaultValue="CRRC", StorageType="uint8")
  CRRC = 0
  JEELY = 1

ENM_SYS_STATUS = enum(DataScope="Exported", HeaderFile="custom_type_definition.h", DefaultValue="SYSINIT", StorageType="uint8")
  STANDBY = 0
  RUN = 1
  POSTRUN = 2
  SYSINIT = 3
  SYSFAIL = 4
  LIMPHOME = 5
  SYSSLEEP = 6
  SYSDERATING = 7

BUS_SIGIN_SLW_TASK_IN = Simulink.Bus(DataScope="Exported", HeaderFile="motor_control_interface.h")
  u16_uADCtlBrdVltg: uint16  % Reference Direct and Quadrature curents
  u16_uADGDVltg: uint16  % Reference Direct and Quadrature curents
  u16_uADPwrTubTemp: uint16  % Reference Direct and Quadrature curents
  u16_uADPCBTemp: uint16  % Reference Direct and Quadrature curents
  u16_uADMotoTemp: uint16  % Reference Direct and Quadrature curents
  u8_tMCUTemp: dt_Temp_u8p0bn40
  busOBD_FaltSt: Bus: BUS_OBD_FALT_STS

dt_RadAng_s16r15b0 = Simulink.NumericType(DataTypeMode="Fixed-point: slope and bias scaling", SignednessBool=true, WordLength=16, FixedExponent=-14, SlopeAdjustmentFactor=1.570796, DataScope="Exported", HeaderFile="custom_type_definition.h")

ENM_STRTUP_TRQ_STATUS = enum(DataScope="Exported", HeaderFile="custom_type_definition.h", DefaultValue="TRQ_CST", StorageType="uint8")
  TRQ_CST = 0
  TRQ_DECRE = 1

ENM_TYPE_FALT = enum(DataScope="Exported", HeaderFile="custom_type_definition.h", DefaultValue="PH_CURR_HI_LVL1", StorageType="uint8")
  PH_CURR_HI_LVL1 = 0
  HW_OVER_CURR = 1
  SPLY_VLTG_LO_LVL1 = 2
  SPLY_VLTG_LO_LVL2 = 3
  SPLY_VLTG_HI_LVL1 = 4
  PWR_TUB_PCB_TEMP_HI_LVL1 = 5
  PWR_TUB_PCB_TEMP_HI_LVL2 = 6
  MOTO_TEMP_HI_LVL1 = 7
  MOTO_TEMP_HI_LVL2 = 8
  COM_FALT = 9
  MOTO_STALL_PERM = 10
  MOTO_STALL_TMP = 11
  NO_LD = 12
  BATT_PWR_HI_LVL1 = 13
  MOTO_SPD_HI_LVL1 = 14
  MOTO_SPD_LO_LVL1 = 15
  CTL_BRD_VLTG_LO_LVL1 = 16
  CTL_BRD_VLTG_HI_LVL1 = 17
  GD_VLTG_LO_LVL1 = 18
  GD_VLTG_HI_LVL1 = 19
  CHIP_FALT = 20
  PHI_SENS_FALT = 21
  PH_CURR_SENS_FALT = 22
  PWR_TUB_PCB_TEMP_SENS_FALT = 23
  MOTO_TEMP_SENS_FALT = 24
  BUSOFF_FALT = 25
  CRASH_FALT = 26
  MOSOPNCIR_FALT = 27
  FAULT_RESERVED4 = 28
  FAULT_RESERVED5 = 29

BUS_OBD_FALT_STS = Simulink.Bus(DataScope="Exported", HeaderFile="motor_control_interface.h")
  bol_flgPhCurrHiLvl1Flg: boolean
  bol_flgHWOvrCurrFlg: boolean  % Actual electric angle
  bol_flgSplyVltgLoLvl1Flg: boolean  % Actual electric angle
  bol_flgSplyVltgLoLvl2Flg: boolean  % Actual electric angle
  bol_flgSplyVltgHiLvl1Flg: boolean  % Actual electric angle
  bol_flgPwrTubPCBTempHiLvl1Flg: boolean  % Actual electric angle
  bol_flgPwrTubPCBTempHiLvl2Flg: boolean  % Actual electric angle
  bol_flgMotoTempHiLvl1Flg: boolean  % Actual electric angle
  bol_flgMotoTempHiLvl2Flg: boolean  % Actual electric angle
  bol_flgComFaltFlg: boolean  % Actual electric angle
  bol_flgMotoStallPermFlg: boolean  % Actual electric angle
  bol_flgMotoStallTmpFlg: boolean  % Actual electric angle
  bol_flgNoLdFlg: boolean  % Actual electric angle
  bol_flgBattPwrHiLvl1Flg: boolean  % Actual electric angle
  bol_flgMotoSpdHiLvl1Flg: boolean  % Actual electric angle
  bol_flgMotoSpdLoLvl1Flg: boolean  % Actual electric angle
  bol_flgCtlBrdVltgLoLvl1Flg: boolean  % Actual electric angle
  bol_flgCtlBrdVltgHiLvl1Flg: boolean  % Actual electric angle
  bol_flgGDVltgLoLvl1Flg: boolean  % Actual electric angle
  bol_flgGDVltgHiLvl1Flg: boolean  % Actual electric angle
  bol_flgChipFaltFlg: boolean  % Actual electric angle
  bol_flgPhiSensFaltFlg: boolean  % Actual electric angle
  bol_flgPhCurrSensFaltFlg: boolean  % Actual electric angle
  bol_flgPwrTubPCBTempSensFaltFlg: boolean  % Actual electric angle
  bol_flgMotoTempSensFaltFlg: boolean  % Actual electric angle
  bol_flgBusOffFaltFlg: boolean  % Actual electric angle
  bol_flgCrashFaltFlg: boolean  % Actual electric angle
  bol_flgMosOpnCirFaltFlg: boolean  % Actual electric angle
  bol_flgReserved4Flg: boolean  % Actual electric angle
  bol_flgReserved5Flg: boolean  % Actual electric angle

BUS_OBD_FALT_STS_TMP = Simulink.Bus(DataScope="Exported", HeaderFile="motor_control_interface.h")
  bol_flgPhCurrHiLvl1Tmp: boolean
  bol_flgHWOvrCurrTmp: boolean  % Actual electric angle
  bol_flgSplyVltgLoLvl1Tmp: boolean  % Actual electric angle
  bol_flgSplyVltgLoLvl2Tmp: boolean  % Actual electric angle
  bol_flgSplyVltgHiLvl1Tmp: boolean  % Actual electric angle
  bol_flgPwrTubPCBTempHiLvl1Tmp: boolean  % Actual electric angle
  bol_flgPwrTubPCBTempHiLvl2Tmp: boolean  % Actual electric angle
  bol_flgMotoTempHiLvl1Tmp: boolean  % Actual electric angle
  bol_flgMotoTempHiLvl2Tmp: boolean  % Actual electric angle
  bol_flgComFaltTmp: boolean  % Actual electric angle
  bol_flgMotoStallPermTmp: boolean  % Actual electric angle
  bol_flgMotoStallTmpTmp: boolean  % Actual electric angle
  bol_flgNoLdTmp: boolean  % Actual electric angle
  bol_flgBattPwrHiLvl1Tmp: boolean  % Actual electric angle
  bol_flgMotoSpdHiLvl1Tmp: boolean  % Actual electric angle
  bol_flgMotoSpdLoLvl1Tmp: boolean  % Actual electric angle
  bol_flgCtlBrdVltgLoLvl1Tmp: boolean  % Actual electric angle
  bol_flgCtlBrdVltgHiLvl1Tmp: boolean  % Actual electric angle
  bol_flgGDVltgLoLvl1Tmp: boolean  % Actual electric angle
  bol_flgGDVltgHiLvl1Tmp: boolean  % Actual electric angle
  bol_flgChipFaltTmp: boolean  % Actual electric angle
  bol_flgPhiSensFaltTmp: boolean  % Actual electric angle
  bol_flgPhCurrSensFaltTmp: boolean  % Actual electric angle
  bol_flgPwrTubPCBTempSensFaltTmp: boolean  % Actual electric angle
  bol_flgMotoTempSensFaltTmp: boolean  % Actual electric angle
  bol_flgBusOffFaltTmp: boolean  % Actual electric angle
  bol_flgCrashFaltTmp: boolean  % Actual electric angle
  bol_flgMosOpnCirFaltTmp: boolean  % Actual electric angle
  bol_flgReserved4Tmp: boolean  % Actual electric angle
  bol_flgReserved5Tmp: boolean  % Actual electric angle

ENM_AG_SENS_CALIB_STATUS = enum(DataScope="Exported", HeaderFile="custom_type_definition.h", DefaultValue="CALIBFAIL", StorageType="uint8")
  CALIBFAIL = 0
  SUCCESS = 1
  ALPHA_PHASE1 = 2
  BETA_PHASE = 3
  WAIT_ALPHA1 = 4
  WAIT_BETA = 5
  ALPHA_PHASE2 = 6
  WAIT_ALPHA2 = 7

dt_SpdCtrlIntgGain_u16p9b0 = Simulink.NumericType(DataTypeMode="Fixed-point: slope and bias scaling", SignednessBool=false, WordLength=16, FixedExponent=0, DataScope="Exported", HeaderFile="custom_type_definition.h")

BUS_DCYCGEN_FST_TASK_IN = Simulink.Bus(DataScope="Exported", HeaderFile="motor_control_interface.h")
  u16_ampDycAmp: dt_DutyCycl_u16p15b0  % Duty cycle amplitude
  u16_phiActElecAg: dt_RadAng_u16r15b0  % Electric angle
  u16_phiDaxQaxVltgAg: dt_RadAng_u16r15b0  % Voltage angle
  enm_stMotoSt: Enum: ENM_MOTO_STATUS  % Motor status
  s16_nPredActElecSpd: dt_Standardize_s16p15b0  % Predicted electric speed
  bol_enPosSCDCalibEnFlg: boolean  % Predicted electric speed

BUS_DCYCGEN_FST_TASK_OUT = Simulink.Bus(DataScope="Exported", HeaderFile="motor_control_interface.h")
  u16_dcycPhDyc: dt_DutyCycl_u16p15b0[3], Min=0, Max=1  % Duty cycle for XYZ phases
  u16_ampMaxNrmVltgAmp: dt_DutyCycl_u16p15b0, Min=0, Max=0.99997  % Maximum normalized voltage amplitude
  u16_phiModulActElecAg: dt_RadAng_u16r15b0, Min=0, Max=6.28309  % Estimated electric angle

BUS_PHVLTGGEN_MED_TASK_IN = Simulink.Bus(DataScope="Exported", HeaderFile="motor_control_interface.h")
  s16_iRefDaxQaxCurr: dt_Standardize_s16p15b0[2]  % Reference Direct and Quadrature curents
  s16_iActPhCurr: dt_Standardize_s16p15b0[3]  % Actual Direct and Quadrature curents
  u16_phiSensActElecAg: dt_RadAng_u16r15b0  % Actual Direct and Quadrature curents
  u16_uSplyVltg: dt_Standardize_u16p15b0  % Supply DC voltage
  enm_stMotoSt: Enum: ENM_MOTO_STATUS  % Motor status
  u16_phiModulActElecAg: dt_RadAng_u16r15b0  % Estimated electric angle
  u16_phiPosSCDCalibElecAg: dt_RadAng_u16r15b0  % Reference electric angle in align state
  u16_dcycPhDyc: dt_DutyCycl_u16p15b0[3]
  bol_enPosSCDCalibEnFlg: boolean  % Reference electric angle in align state
  enm_modeAgEvalMode: Enum: ENM_AG_POS_EVAL_MODE  % Reference electric angle in align state
  s16_nRmpRefElecSpd: dt_Standardize_s16p15b0
  u8_tPCBTempSubs: dt_Temp_u8p0bn40  % Reference electric angle in align state
  u16_ampMaxNrmVltgAmp: dt_DutyCycl_u16p15b0

BUS_PHVLTGGEN_MED_TASK_OUT = Simulink.Bus(DataScope="Exported", HeaderFile="motor_control_interface.h")
  u16_ampDycAmp: dt_DutyCycl_u16p15b0, Min=0, Max=1  % Duty cycle amplitude
  u16_phiDaxQaxVltgAg: dt_RadAng_u16r15b0, Min=0, Max=6.28309  % Voltage angle
  u16_phiActElecAg: dt_RadAng_u16r15b0, Min=0, Max=6.28309  % Actual electric angle
  s16_nActElecSpd: dt_Standardize_s16p15b0, Min=-0.99997, Max=0.99997  % Actual electric speed
  s16_iActDaxQaxCurr: dt_Standardize_s16p15b0[2], Min=-0.99997, Max=0.99997  % Actual Direct and Quadrature current
  s16_nPredActElecSpd: dt_Standardize_s16p15b0, Min=-0.99997, Max=0.99997  % Predicted electric speed
  s16_uModulDaxQaxVltg: dt_Standardize_s16p15b0[2], Min=-0.99997, Max=0.99997  % Reference Direct and Quadrature currents
  u16_phiSenlElecAgSensElecAgDvt: dt_RadAng_u16r15b0, Min=0, Max=6.28309
  u16_psiEstPermMagFlx: dt_Standardize_u16p15b0, Min=0, Max=0.99997
  s16_phiOpnLpAgClsLpAgDvt: dt_RadAng_s16r15b0, Min=-3.14154, Max=3.14154

BUS_PHCURRGEN_SLW_TASK_IN = Simulink.Bus(DataScope="Exported", HeaderFile="motor_control_interface.h")
  s16_nRefElecSpd: dt_Standardize_s16p15b0  % Reference mechanical speed in RPM
  s16_nActElecSpd: dt_Standardize_s16p15b0  % Actual electric speed in rad/s
  s16_nRmpRefElecSpd: dt_Standardize_s16p15b0  % Permanent magnetic flux
  s16_trqRefTqLim: dt_Standardize_s16p15b0  % DC supply current limit for derating provided by BSW
  bol_flgShOffFlg: boolean
  bol_enPosSCDCalibEnFlg: boolean
  s16_trqPosSCDCalibRefTq: dt_Standardize_s16p15b0  % Reference Direct and Quadrature currents
  enm_modeAgEvalMode: Enum: ENM_AG_POS_EVAL_MODE  % Reference Direct and Quadrature currents
  s16_phiOpnLpAgClsLpAgDvt: dt_RadAng_s16r15b0  % Reference Direct and Quadrature currents

BUS_PHCURRGEN_SLW_TASK_OUT = Simulink.Bus(DataScope="Exported", HeaderFile="motor_control_interface.h")
  s16_iRefDaxQaxCurr: dt_Standardize_s16p15b0[2], Min=-0.99997, Max=0.99997  % Reference Direct and Quadrature currents
  enm_stMotoSt: Enum: ENM_MOTO_STATUS  % enmMotStas

BUS_AST_SLW_TASK_IN = Simulink.Bus(DataScope="Exported", HeaderFile="motor_control_interface.h")
  s16_nComRefMechSpd: dt_Standardize_s16p15b0  % Reference mechanical speed in RPM
  s16_nActElecSpd: dt_Standardize_s16p15b0  % Actual electric speed in rad/s
  s16_uModulDaxQaxVltg: dt_Standardize_s16p15b0[2]
  u16_uSplyVltg: dt_Standardize_u16p15b0
  s16_iActDaxQaxCurr: dt_Standardize_s16p15b0[2]
  enm_stMotoSt: Enum: ENM_MOTO_STATUS  % Actual electric angle
  bol_enPosSCDCalibEnFlg: boolean  % Actual electric angle
  u16_phiSensActElecAg: dt_RadAng_u16r15b0  % Measured rotor angle by the GMR sensor
  u8_stMaxFaltLvl: uint8  % Measured rotor angle by the GMR sensor
  busOBD_FaltSt: Bus: BUS_OBD_FALT_STS  % Measured rotor angle by the GMR sensor
  s16_nFaltRefMechSpd: dt_Standardize_s16p15b0  % Measured rotor angle by the GMR sensor
  s16_trqFaltRefTqLim: dt_Standardize_s16p15b0  % Measured rotor angle by the GMR sensor
  u8_modeMCUOpMode: uint8  % Measured rotor angle by the GMR sensor
  u8_tPCBTempSubs: dt_Temp_u8p0bn40  % Measured rotor angle by the GMR sensor
  bol_flgOvrTstCtlUDS2F: boolean
  bol_flgPhiSensFaltRawFlg: boolean  % Reference Direct and Quadrature curents
  u8_FrzFrmSaveFlg: uint8  % Reference Direct and Quadrature curents
  bol_flgSlepEn: boolean  % Reference Direct and Quadrature curents

BUS_AST_SLW_TASK_OUT = Simulink.Bus(DataScope="Exported", HeaderFile="motor_control_interface.h")
  s16_iEstSplyCurr: dt_Standardize_s16p15b0, Min=-0.99997, Max=0.99997  % Estimated DC supply current
  s16_ampActPhCurrAmp: dt_Standardize_s16p15b0, Min=-0.99997, Max=0.99997  % Actual line current
  s16_trqPosSCDCalibRefTq: dt_Standardize_s16p15b0, Min=-0.99997, Max=0.99997  % Reference current in align state
  u16_phiPosSCDCalibElecAg: dt_RadAng_u16r15b0, Min=0, Max=6.28309  % Reference electric angle in align state
  bol_flgPosSCDCalibSucFlg: boolean, Min=0, Max=1  % Judge whether calibration is successful
  u16_ADSensMechAgDvt: uint16, Min=0, Max=65535  % mechanical angle error
  enm_stPosSCDCalibSt: Enum: ENM_AG_SENS_CALIB_STATUS  % Align state
  bol_flgPosSCDCalibPermFail: boolean, Min=0, Max=1  % Align fail
  s16_trqRefTqLim: dt_Standardize_s16p15b0, Min=-0.99997, Max=0.99997  % Align fail
  s16_nRmpRefElecSpd: dt_Standardize_s16p15b0, Min=-0.99997, Max=0.99997  % Align fail
  bol_flgShOffFlg: boolean, Min=0, Max=1
  s16_nRefElecSpd: dt_Standardize_s16p15b0, Min=-0.99997, Max=0.99997
  enm_stSysSt: Enum: ENM_SYS_STATUS
  s16_pwrSplyElecPwr: dt_Standardize_s16p15b0, Min=-0.99997, Max=0.99997
  enm_modeAgEvalMode: Enum: ENM_AG_POS_EVAL_MODE
  u16_phiSensElecAgDvt: dt_RadAng_u16r15b0
  s16_nActElecSpdComFlt: dt_Standardize_s16p15b0

BUS_OBD_SLW_TASK_IN = Simulink.Bus(DataScope="Exported", HeaderFile="motor_control_interface.h")
  s16_nRmpRefElecSpd: dt_Standardize_s16p15b0
  s16_nActElecSpd: dt_Standardize_s16p15b0  % Actual electric speed in rad/s
  enm_stMotoSt: Enum: ENM_MOTO_STATUS  % Actual electric angle
  s16_ampActPhCurrAmp: dt_Standardize_s16p15b0  % Actual electric angle
  u16_uSplyVltg: dt_Standardize_u16p15b0  % Actual electric angle
  u8_tPwrTubTemp: dt_Temp_u8p0bn40  % Actual electric angle
  u8_tPCBTemp: dt_Temp_u8p0bn40  % Actual electric angle
  u8_tMotoTemp: dt_Temp_u8p0bn40  % Actual electric angle
  u8_ctLossNoData: uint8  % Actual electric angle
  u8_ctComRolCnt: uint8  % Actual electric angle
  u16_uCtlBrdVltg: dt_Standardize_u16p15b0  % Actual electric angle
  enm_stSysSt: Enum: ENM_SYS_STATUS
  bol_flgHWOvrCurrFalt: boolean
  bol_flgChipFalt: boolean
  bol_flgPhiSensFalt: boolean
  u16_uADActPhCurr: uint16[3]
  u16_uADPwrTubTemp: uint16
  u16_uADPCBTemp: uint16
  u16_uADMotoTemp: uint16
  s16_pwrSplyElecPwr: dt_Standardize_s16p15b0
  s16_iActPhCurr: dt_Standardize_s16p15b0[3]
  s16_iEstSplyCurr: dt_Standardize_s16p15b0
  s16_iRefDaxQaxCurr: dt_Standardize_s16p15b0[2]
  s16_iActDaxQaxCurr: dt_Standardize_s16p15b0[2]
  bol_flgShOffFlg: boolean
  bol_enFaltInfoClrUDS14: boolean
  u16_vVehSpd: fixdt(0,16,10^-2,0)
  u32_disOde: fixdt(0,32,10^-1,0)
  u32_tiStamHi: uint32
  u32_tiStamLo: uint32
  u8_psiOilFlow: fixdt(0,8,5^-1,0)
  u8_tOilTemp: dt_Temp_u8p0bn40
  bol_enPosSCDCalibEnFlg: boolean
  u8_psiUpLimOilFlow: fixdt(0,8,5^-1,0)
  bol_flgBusOffFaltRaw: boolean
  bol_flgFaltEnFlgUDS85: boolean
  bol_flgWBSSt: boolean
  bol_flgCRCFaltRaw: boolean
  bol_flgMesgLngthFaltRaw: boolean
  s16_nComRefMechSpd: dt_Standardize_s16p15b0
  u16_psiEstPermMagFlx: dt_Standardize_u16p15b0
  enm_modeAgEvalMode: Enum: ENM_AG_POS_EVAL_MODE
  bol_flgCrashFalt: boolean
  bol_flgGDVltgHiLvl1: boolean
  bol_flgGDVltgLoLvl1: boolean
  u8_tMCUTemp: dt_Temp_u8p0bn40
  u8_tPCBTempSubs: dt_Temp_u8p0bn40
  u16_uGDVltg: dt_Standardize_u16p15b0
  bol_flgMosOpnCirFalt: boolean

BUS_OBD_SLW_TASK_OUT = Simulink.Bus(DataScope="Exported", HeaderFile="motor_control_interface.h")
  busOBD_FaltSt: Bus: BUS_OBD_FALT_STS
  u8_stMaxFaltLvl: uint8, Min=0, Max=255  % Reference Direct and Quadrature curents
  s16_nFaltRefMechSpd: dt_Standardize_s16p15b0, Min=-0.99997, Max=0.99997  % Reference Direct and Quadrature curents
  s16_trqFaltRefTqLim: dt_Standardize_s16p15b0, Min=-0.99997, Max=0.99997  % Reference Direct and Quadrature curents
  bol_flgPhiSensFaltRawFlg: boolean, Min=0, Max=1  % Reference Direct and Quadrature curents
  bol_flgComNodeLosFaltDeb: boolean, Min=0, Max=1  % Reference Direct and Quadrature curents
  bol_flgComRolCntFaltDeb: boolean, Min=0, Max=1  % Reference Direct and Quadrature curents
  bol_flgCRCFaltDeb: boolean, Min=0, Max=1  % Reference Direct and Quadrature curents
  busOBD_FaltStTmp: Bus: BUS_OBD_FALT_STS_TMP

BUS_SIGIN_MED_TASK_IN = Simulink.Bus(DataScope="Exported", HeaderFile="motor_control_interface.h")
  u16_ADSensActMechAg: uint16  % Reference Direct and Quadrature curents
  u16_uADActPhCurr: uint16[3]  % Reference Direct and Quadrature curents
  u16_uADActPhCurrOfs: uint16  % Reference Direct and Quadrature curents
  u8_numSectNum: uint8
  u16_uADSplyVltg: uint16  % Reference Direct and Quadrature curents
  u16_phiDvtSensElecAg: dt_RadAng_u16r15b0  % Reference Direct and Quadrature curents
  bol_enPosSCDCalibEnFlg: boolean  % Reference Direct and Quadrature curents

BUS_SIGIN_MED_TASK_OUT = Simulink.Bus(DataScope="Exported", HeaderFile="motor_control_interface.h")
  u16_phiSensActElecAg: dt_RadAng_u16r15b0, Min=0, Max=6.28299356  % Duty cycle amplitude
  s16_iActPhCurr: dt_Standardize_s16p15b0[3], Min=-0.99997, Max=0.99997  % Duty cycle amplitude
  u16_uSplyVltg: dt_Standardize_u16p15b0, Min=0, Max=0.99997  % Reference Direct and Quadrature curents

BUS_SIGIN_SLW_TASK_OUT = Simulink.Bus(DataScope="Exported", HeaderFile="motor_control_interface.h")
  u16_uCtlBrdVltg: dt_Standardize_u16p15b0, Min=0, Max=0.99997  % Reference Direct and Quadrature curents
  u16_uGDVltg: dt_Standardize_u16p15b0, Min=0, Max=0.99997  % Reference Direct and Quadrature curents
  u8_tPwrTubTemp: dt_Temp_u8p0bn40, Min=-40, Max=215  % Reference Direct and Quadrature curents
  u8_tPCBTemp: dt_Temp_u8p0bn40, Min=-40, Max=215  % Reference Direct and Quadrature curents
  u8_tMotoTemp: dt_Temp_u8p0bn40, Min=-40, Max=215  % Reference Direct and Quadrature curents
  u8_tPCBTempSubs: dt_Temp_u8p0bn40, Min=-40, Max=215  % Reference Direct and Quadrature curents