% Simulink data dictionary dd_foc_dictionary.sldd
% references dd_foc_configuration_parameter.sldd
% references dd_foc_tunable_parameter.sldd
% references dd_foc_measurement_signal.sldd

cfg_MediumTaskCodeGeneration_v01 = Simulink.ConfigSet(StartTime="0", StopTime="5", FixedStep="round(double(cstMedTaskSampTime),6)", Solver="FixedStepAuto", ProdHWDeviceType="ARM Compatible->ARM Cortex-M", SystemTargetFile="ert.tlc", TargetLang="C")  % This code generation setting allows to generate tasks with input and output data
  % represented as arguments of a function.
  % Sinchronization between tasks has been removed.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

cfg_MotCtrlStatMachCodeGeneration_v01 = Simulink.ConfigSet(StartTime="0", StopTime="5", FixedStep="round(double(cstSlowTaskSampTime),4)", Solver="FixedStepAuto", ProdHWDeviceType="ARM Compatible->ARM Cortex-M", SystemTargetFile="ert.tlc", TargetLang="C")  % This code generation setting allows to generate tasks with input and output data
  % represented as arguments of a function.
  % Sinchronization between tasks has been removed.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

cfg_SlowTaskCodeGeneration_v01 = Simulink.ConfigSet(StartTime="0", StopTime="5", FixedStep="round(double(cstSlowTaskSampTime),4)", Solver="FixedStepAuto", ProdHWDeviceType="ARM Compatible->ARM Cortex-M", SystemTargetFile="ert.tlc", TargetLang="C")  % This code generation setting allows to generate tasks with input and output data
  % represented as arguments of a function.
  % Sinchronization between tasks has been removed.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

cfg_FastTaskCodeGeneration_v01 = Simulink.ConfigSet(StartTime="0", StopTime="5", FixedStep="round(double(Cdbl_tiFstTaskSmpTi),8)", Solver="FixedStepAuto", ProdHWDeviceType="ARM Compatible->ARM Cortex-M", SystemTargetFile="ert.tlc", TargetLang="C")  % This code generation setting allows to generate tasks with input and output data
  % represented as arguments of a function.
  % Sinchronization between tasks has been removed.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

Gu8_RollingMin_C = Simulink.Parameter(0, StorageClass="ImportFromFile", HeaderFile="motor_control_param.h", DataType="uint8")
Gu8_RollingMax_C = Simulink.Parameter(15, StorageClass="ImportFromFile", HeaderFile="motor_control_param.h", DataType="uint8")