% Simulink data dictionary dd_foc_measurement_signal.sldd
% references dd_foc_data_type.sldd

busAST_SlwTaskIn = Simulink.Signal(StorageClass="ExportedGlobal", DataType="Bus: BUS_AST_SLW_TASK_IN")
busAST_SlwTaskOut = Simulink.Signal(StorageClass="ExportedGlobal", DataType="Bus: BUS_AST_SLW_TASK_OUT")
busOBD_SlwTaskIn = Simulink.Signal(StorageClass="ExportedGlobal", DataType="Bus: BUS_OBD_SLW_TASK_IN")
busOBD_SlwTaskOut = Simulink.Signal(StorageClass="ExportedGlobal", DataType="Bus: BUS_OBD_SLW_TASK_OUT")
busSigIn_SlwTaskIn = Simulink.Signal(StorageClass="ExportedGlobal", DataType="Bus: BUS_SIGIN_SLW_TASK_IN")
busSigIn_SlwTaskOut = Simulink.Signal(StorageClass="ExportedGlobal", DataType="Bus: BUS_SIGIN_SLW_TASK_OUT")
busSigIn_MedTaskIn = Simulink.Signal(StorageClass="ExportedGlobal", DataType="Bus: BUS_SIGIN_MED_TASK_IN")
busSigIn_MedTaskOut = Simulink.Signal(StorageClass="ExportedGlobal", DataType="Bus: BUS_SIGIN_MED_TASK_OUT")
busDcycGen_FstTaskIn = Simulink.Signal(StorageClass="ExportedGlobal", DataType="Bus: BUS_DCYCGEN_FST_TASK_IN")
busDcycGen_FstTaskOut = Simulink.Signal(StorageClass="ExportedGlobal", DataType="Bus: BUS_DCYCGEN_FST_TASK_OUT")
busPhVltgGen_MedTaskIn = Simulink.Signal(StorageClass="ExportedGlobal", DataType="Bus: BUS_PHVLTGGEN_MED_TASK_IN")
busPhVltgGen_MedTaskOut = Simulink.Signal(StorageClass="ExportedGlobal", DataType="Bus: BUS_PHVLTGGEN_MED_TASK_OUT")
busPhCurrGen_SlwTaskIn = Simulink.Signal(StorageClass="ExportedGlobal", DataType="Bus: BUS_PHCURRGEN_SLW_TASK_IN")
busPhCurrGen_SlwTaskOut = Simulink.Signal(StorageClass="ExportedGlobal", DataType="Bus: BUS_PHCURRGEN_SLW_TASK_OUT")
EE_FrzFrmstDTCBit3 = Simulink.Signal(StorageClass="ImportFromFile", HeaderFile="SaveFaltInfo.h", DataType="boolean")
EE_FrzFrmstDTCBit7 = Simulink.Signal(StorageClass="ImportFromFile", HeaderFile="SaveFaltInfo.h", DataType="boolean")
EE_FrzFrmFaltNum = Simulink.Signal(StorageClass="ImportFromFile", HeaderFile="SaveFaltInfo.h", DataType="uint8")
EE_FrzFrmuSplyVltg = Simulink.Signal(StorageClass="ImportFromFile", HeaderFile="SaveFaltInfo.h", DataType="dt_Standardize_u16p15b0")
EE_FrzFrmiRefQaxCurr = Simulink.Signal(StorageClass="ImportFromFile", HeaderFile="SaveFaltInfo.h", DataType="dt_Standardize_s16p15b0")
EE_FrzFrmiActQaxCurr = Simulink.Signal(StorageClass="ImportFromFile", HeaderFile="SaveFaltInfo.h", DataType="dt_Standardize_s16p15b0")
EE_FrzFrmiEstSplyCurr = Simulink.Signal(StorageClass="ImportFromFile", HeaderFile="SaveFaltInfo.h", DataType="dt_Standardize_s16p15b0")
EE_FrzFrmnRmpRefElecSpd = Simulink.Signal(StorageClass="ImportFromFile", HeaderFile="SaveFaltInfo.h", DataType="dt_Standardize_s16p15b0")
EE_FrzFrmnActElecSpd = Simulink.Signal(StorageClass="ImportFromFile", HeaderFile="SaveFaltInfo.h", DataType="dt_Standardize_s16p15b0")
EE_FrzFrmuCtlBrdVltg = Simulink.Signal(StorageClass="ImportFromFile", HeaderFile="SaveFaltInfo.h", DataType="dt_Standardize_u16p15b0")
EE_FrzFrmstMotoSt = Simulink.Signal(StorageClass="ImportFromFile", HeaderFile="SaveFaltInfo.h", DataType="Enum: ENM_MOTO_STATUS")
EE_FrzFrmflgShOffFlg = Simulink.Signal(StorageClass="ImportFromFile", HeaderFile="SaveFaltInfo.h", DataType="boolean")
EE_FrzFrmtMotoTemp = Simulink.Signal(StorageClass="ImportFromFile", HeaderFile="SaveFaltInfo.h", DataType="dt_Temp_u8p0bn40")
EE_FrzFrmtPwrTubTemp = Simulink.Signal(StorageClass="ImportFromFile", HeaderFile="SaveFaltInfo.h", DataType="dt_Temp_u8p0bn40")
EE_FrzFrmtPCBTemp = Simulink.Signal(StorageClass="ImportFromFile", HeaderFile="SaveFaltInfo.h", DataType="dt_Temp_u8p0bn40")
EE_FrzFrmiActPhUCurr = Simulink.Signal(StorageClass="ImportFromFile", HeaderFile="SaveFaltInfo.h", DataType="dt_Standardize_s16p15b0")
EE_FrzFrmiActPhVCurr = Simulink.Signal(StorageClass="ImportFromFile", HeaderFile="SaveFaltInfo.h", DataType="dt_Standardize_s16p15b0")
EE_FrzFrmOde = Simulink.Signal(StorageClass="ImportFromFile", HeaderFile="SaveFaltInfo.h", DataType="uint32")
EE_FrzFrmTiStamHi = Simulink.Signal(StorageClass="ImportFromFile", HeaderFile="SaveFaltInfo.h", DataType="uint32")
EE_FrzFrmTiStamLo = Simulink.Signal(StorageClass="ImportFromFile", HeaderFile="SaveFaltInfo.h", DataType="uint32")
EE_FrzFrmActOilFlow = Simulink.Signal(StorageClass="ImportFromFile", HeaderFile="SaveFaltInfo.h", DataType="uint8")
EE_FrzFrmActOilTemp = Simulink.Signal(StorageClass="ImportFromFile", HeaderFile="SaveFaltInfo.h", DataType="dt_Temp_u8p0bn40")
EE_FrzFrmflgPhiCalibSuc = Simulink.Signal(StorageClass="ImportFromFile", HeaderFile="SaveFaltInfo.h", DataType="boolean")
EE_FrzFrmUpLimOilFlow = Simulink.Signal(StorageClass="ImportFromFile", HeaderFile="SaveFaltInfo.h", DataType="uint8")
EE_FrzFrmRunTi = Simulink.Signal(StorageClass="ImportFromFile", HeaderFile="SaveFaltInfo.h", DataType="uint32")
EE_SystiRun = Simulink.Signal(StorageClass="ImportFromFile", HeaderFile="SaveFaltInfo.h", DataType="uint32")
EE_SystiHFRun = Simulink.Signal(StorageClass="ImportFromFile", HeaderFile="SaveFaltInfo.h", DataType="uint16")
EE_FrzFrmHFRunTi = Simulink.Signal(StorageClass="ImportFromFile", HeaderFile="SaveFaltInfo.h", DataType="uint16")
EE_FrzFrmvVehSpd = Simulink.Signal(StorageClass="ImportFromFile", HeaderFile="SaveFaltInfo.h", DataType="uint16")
busOBD_DSMSaveInfoOut = Simulink.Signal(StorageClass="ImportFromFile", HeaderFile="SaveFaltInfo.h", DataType="Bus: BUS_OBD_DSM_SAVE_INFO")