% Simulink data dictionary dd_foc_tunable_parameter.sldd
% references dd_foc_data_type.sldd

Gbol_flgFaltManEnFlg_C = Simulink.Parameter(true, StorageClass="ImportFromFile", HeaderFile="motor_control_param.h", DataType="boolean")
Gbol_flgDaxQaxCurrClpFlg_C = Simulink.Parameter(false, StorageClass="ImportFromFile", HeaderFile="motor_control_param.h", DataType="boolean")
Gbol_flgVltgFrqCtlEnFlg_C = Simulink.Parameter(false, StorageClass="ImportFromFile", HeaderFile="motor_control_param.h", DataType="boolean")
Genm_modePWMMode_C = Simulink.Parameter(ENM_PWM_MODE.S3APWM, StorageClass="ImportFromFile", HeaderFile="motor_control_param.h", DataType="Enum: ENM_PWM_MODE")
Genm_modePhCurrSmpMode_C = Simulink.Parameter(ENM_PH_CURR_SMP_MODE.TWOSHT_PHA, StorageClass="ImportFromFile", HeaderFile="motor_control_param.h", DataType="Enum: ENM_PH_CURR_SMP_MODE")
Gu16_uADPhUCurrFaltHiLim_C = Simulink.Parameter(4000, StorageClass="ImportFromFile", HeaderFile="motor_control_param.h", DataType="uint16")
Gu16_uADPhVCurrFaltHiLim_C = Simulink.Parameter(4000, StorageClass="ImportFromFile", HeaderFile="motor_control_param.h", DataType="uint16")
Gu16_fEstAgDvtCompFrq_C = Simulink.Parameter(707, StorageClass="ImportFromFile", HeaderFile="motor_control_param.h", DataType="fixdt(0,16,2^-4,0)")
Gu16_ctSenlTrnsElecAgConfCnt_C = Simulink.Parameter(400, StorageClass="ImportFromFile", HeaderFile="motor_control_param.h", DataType="uint16")

Gu16_facDaxCurrCtlKi_C = Simulink.Parameter(400, StorageClass="ImportFromFile", HeaderFile="motor_control_param.h", DataType="dt_CurrCtrlIntgGain_u16p5b0")  % The integral gain for direct current PI is computed in order to get a behaviour like a 1st order system:
  % DirCurrCtrlKi = DirCurrCtrlKp * (AmbPhsRstn/DirIndct)
  % 193
  % 96.5
  % 900

Gu16_facQaxCurrCtlKi_C = Simulink.Parameter(400, StorageClass="ImportFromFile", HeaderFile="motor_control_param.h", DataType="dt_CurrCtrlIntgGain_u16p5b0")  % The integral gain for direct current PI is computed in order to get a behaviour like a 1st order system:
  % QdrtCurrCtrlKi = QdrtCurrCtrlKp * (AmbPhsRstn/QdrtIndct)
  % 100
  % 623

Gu16_ctMaxMotoSpdDvtConfCnt_C = Simulink.Parameter(300, StorageClass="ImportFromFile", HeaderFile="motor_control_param.h", DataType="uint16")
Gu16_ctMinMotoSpdDvtRcvyCnt_C = Simulink.Parameter(300, StorageClass="ImportFromFile", HeaderFile="motor_control_param.h", DataType="uint16")
Gu16_ctAlgnAlPhStCnt_C = Simulink.Parameter(200, StorageClass="ImportFromFile", HeaderFile="motor_control_param.h", DataType="uint16")
Gu16_ctAlgnBePhStCnt_C = Simulink.Parameter(200, StorageClass="ImportFromFile", HeaderFile="motor_control_param.h", DataType="uint16")
Gu16_ctAlgnTmpFailStCnt_C = Simulink.Parameter(200, StorageClass="ImportFromFile", HeaderFile="motor_control_param.h", DataType="uint16")
Gu8_tMotoTempHiLvl1ConfTrs_C = Simulink.Parameter(140, StorageClass="ImportFromFile", HeaderFile="motor_control_param.h", DataType="dt_Temp_u8p0bn40")
Gu8_tMotoTempHiLvl2ConfTrs_C = Simulink.Parameter(140, StorageClass="ImportFromFile", HeaderFile="motor_control_param.h", DataType="dt_Temp_u8p0bn40")
Gu8_tPCBTempHiLvl1ConfTrs_C = Simulink.Parameter(140, StorageClass="ImportFromFile", HeaderFile="motor_control_param.h", DataType="dt_Temp_u8p0bn40")
Gu8_tPCBTempHiLvl2ConfTrs_C = Simulink.Parameter(140, StorageClass="ImportFromFile", HeaderFile="motor_control_param.h", DataType="dt_Temp_u8p0bn40")
Gu8_tPwrTubTempHiLvl1ConfTrs_C = Simulink.Parameter(140, StorageClass="ImportFromFile", HeaderFile="motor_control_param.h", DataType="dt_Temp_u8p0bn40")
Gu8_tPwrTubTempHiLvl2ConfTrs_C = Simulink.Parameter(140, StorageClass="ImportFromFile", HeaderFile="motor_control_param.h", DataType="dt_Temp_u8p0bn40")
Gu8_tMotoTempHiLvl1RcvyTrs_C = Simulink.Parameter(138, StorageClass="ImportFromFile", HeaderFile="motor_control_param.h", DataType="dt_Temp_u8p0bn40")
Gu8_tMotoTempHiLvl2RcvyTrs_C = Simulink.Parameter(138, StorageClass="ImportFromFile", HeaderFile="motor_control_param.h", DataType="dt_Temp_u8p0bn40")
Gu8_tPCBTempHiLvl1RcvyTrs_C = Simulink.Parameter(138, StorageClass="ImportFromFile", HeaderFile="motor_control_param.h", DataType="dt_Temp_u8p0bn40")
Gu8_tPCBTempHiLvl2RcvyTrs_C = Simulink.Parameter(138, StorageClass="ImportFromFile", HeaderFile="motor_control_param.h", DataType="dt_Temp_u8p0bn40")
Gu8_tPwrTubTempHiLvl1RcvyTrs_C = Simulink.Parameter(138, StorageClass="ImportFromFile", HeaderFile="motor_control_param.h", DataType="dt_Temp_u8p0bn40")
Gu8_tPwrTubTempHiLvl2RcvyTrs_C = Simulink.Parameter(138, StorageClass="ImportFromFile", HeaderFile="motor_control_param.h", DataType="dt_Temp_u8p0bn40")
Gu8_PhCurrHiLvl2ConfCnt_C = Simulink.Parameter(101, StorageClass="ImportFromFile", HeaderFile="motor_control_param.h", DataType="uint8")
Gu8_PhCurrHiLvl2RcvyCnt_C = Simulink.Parameter(101, StorageClass="ImportFromFile", HeaderFile="motor_control_param.h", DataType="uint8")
Gu8_ctMotoTempHiLvl3ConfCnt_C = Simulink.Parameter(100, StorageClass="ImportFromFile", HeaderFile="motor_control_param.h", DataType="uint8")
Gu8_ctMotoTempHiLvl3RcvyCnt_C = Simulink.Parameter(100, StorageClass="ImportFromFile", HeaderFile="motor_control_param.h", DataType="uint8")
Gu16_ctAlgnStEndCnt_C = Simulink.Parameter(100, StorageClass="ImportFromFile", HeaderFile="motor_control_param.h", DataType="uint16")
Gu16_ctLmpHmeDurCnt_C = Simulink.Parameter(100, StorageClass="ImportFromFile", HeaderFile="motor_control_param.h", DataType="uint16")
Gu16_uADPhUCurrFaltLoLim_C = Simulink.Parameter(100, StorageClass="ImportFromFile", HeaderFile="motor_control_param.h", DataType="uint16")
Gu16_uADPhVCurrFaltLoLim_C = Simulink.Parameter(100, StorageClass="ImportFromFile", HeaderFile="motor_control_param.h", DataType="uint16")
Gu16_ctAlgnWaitAlStCnt_C = Simulink.Parameter(50, StorageClass="ImportFromFile", HeaderFile="motor_control_param.h", DataType="uint16")
Gu16_ctAlgnWaitBeStCnt_C = Simulink.Parameter(50, StorageClass="ImportFromFile", HeaderFile="motor_control_param.h", DataType="uint16")
Gs16_facOpnLpClsLpAgRiseRate_C = Simulink.Parameter(20, StorageClass="ImportFromFile", HeaderFile="motor_control_param.h", DataType="fixdt(1,16,2^-2,0)")
Gu16_ctSysStInitWaitCnt_C = Simulink.Parameter(10, StorageClass="ImportFromFile", HeaderFile="motor_control_param.h", DataType="uint16")
Gu16_ctFaltDiaSlwSdlCnt_C = Simulink.Parameter(10, StorageClass="ImportFromFile", HeaderFile="motor_control_param.h", DataType="uint16")
Gu16_ctFaltDiaComSdlCnt_C = Simulink.Parameter(10, StorageClass="ImportFromFile", HeaderFile="motor_control_param.h", DataType="uint16")
Gu8_ctComFramLosFaltJudgCnt_C = Simulink.Parameter(8, StorageClass="ImportFromFile", HeaderFile="motor_control_param.h", DataType="uint8")

Gu16_facSpdCtlKi_C = Simulink.Parameter(8, StorageClass="ImportFromFile", HeaderFile="motor_control_param.h", DataType="dt_SpdCtrlIntgGain_u16p9b0")  % 0.00390625*
  % 0.00078125
  % 10
  % 8

Gs16_facStrtUpTqRiseRate_C = Simulink.Parameter(5, StorageClass="ImportFromFile", HeaderFile="motor_control_param.h", DataType="fixdt(1,16,2^-2,0)")
Gu8_numPPNum_C = Simulink.Parameter(5, StorageClass="ImportFromFile", HeaderFile="motor_param.h", DataType="uint8")
Gu8_ctDataExcdLimFaltJudgCnt_C = Simulink.Parameter(5, StorageClass="ImportFromFile", HeaderFile="motor_control_param.h", DataType="uint8")
Gu16_phiAlgnAlPhElecAg_C = Simulink.Parameter(4.71239, StorageClass="ImportFromFile", HeaderFile="motor_control_param.h", DataType="dt_RadAng_u16r15b0", Min=0, Max=6.28309)
Gs16_facAlgnTqRiseRate_C = Simulink.Parameter(2.325, StorageClass="ImportFromFile", HeaderFile="motor_control_param.h", DataType="fixdt(1,16,2^-9,0)")
Gs16_facRefSpdRisSlwRate_C = Simulink.Parameter(2, StorageClass="ImportFromFile", HeaderFile="motor_control_param.h", DataType="dt_RefSpdSlewRate_s16p12b0")  % 2.44
Gu16_phiTheoBePhElecAg_C = Simulink.Parameter(1.570796, StorageClass="ImportFromFile", HeaderFile="motor_control_param.h", DataType="dt_RadAng_u16r15b0")

Gu16_facSpdCtlKp_C = Simulink.Parameter(1.5, StorageClass="ImportFromFile", HeaderFile="motor_control_param.h", DataType="dt_SpdCtrlPropGain_u16p12b0")  % 0.00026666666666666668
  % 2.4576
  % 0.8
  % 1.5

Gu16_facOvrModulFac_C = Simulink.Parameter(1, StorageClass="ImportFromFile", HeaderFile="motor_control_param.h", DataType="dt_OmodFact_u16p15b0")
Gu16_rMaxVltgAmpRat_C = Simulink.Parameter(1, StorageClass="ImportFromFile", HeaderFile="motor_control_param.h", DataType="dt_DutyCycl_u16p15b0")
Gu16_ctFaltDiaFstSdlCnt_C = Simulink.Parameter(1, StorageClass="ImportFromFile", HeaderFile="motor_control_param.h", DataType="uint16")
Gs16_nPLLElecAgSpdUpLim_C = Simulink.Parameter(0.8, StorageClass="ImportFromFile", HeaderFile="motor_control_param.h", DataType="dt_Standardize_s16p15b0")
Gu16_phiMaxSenlTrnsElecAg_C = Simulink.Parameter(0.785, StorageClass="ImportFromFile", HeaderFile="motor_control_param.h", DataType="dt_RadAng_u16r15b0", Min=0, Max=6.28309)
Gs16_trqTqUpLim_C = Simulink.Parameter(0.5, StorageClass="ImportFromFile", HeaderFile="motor_control_param.h", DataType="dt_Standardize_s16p15b0")
Gu16_phiMinAlgnElecAngDvt_C = Simulink.Parameter(0.349065, StorageClass="ImportFromFile", HeaderFile="motor_control_param.h", DataType="dt_RadAng_u16r15b0")
Gu16_uSplyVltgHiLvl1ConfTrs_C = Simulink.Parameter(0.2890625, StorageClass="ImportFromFile", HeaderFile="motor_control_param.h", DataType="dt_Standardize_u16p15b0")
Gu16_pwrBattPwrHiLvl1ConfTrs_C = Simulink.Parameter(0.289, StorageClass="ImportFromFile", HeaderFile="motor_control_param.h", DataType="dt_Standardize_u16p15b0")
Gu16_uSplyVltgHiLvl1RcvyTrs_C = Simulink.Parameter(0.28125, StorageClass="ImportFromFile", HeaderFile="motor_control_param.h", DataType="dt_Standardize_u16p15b0")
Gu16_uCtlBrdVltgHiLvl1RcvyTrs_C = Simulink.Parameter(0.28125, StorageClass="ImportFromFile", HeaderFile="motor_control_param.h", DataType="dt_Standardize_u16p15b0")
Gu16_uComDiaDisblHiLvlConfTrs_C = Simulink.Parameter(0.25, StorageClass="ImportFromFile", HeaderFile="motor_control_param.h", DataType="dt_Standardize_u16p15b0")
Gu16_uComDiaDisblHiLvlRcvyTrs_C = Simulink.Parameter(0.2421875, StorageClass="ImportFromFile", HeaderFile="motor_control_param.h", DataType="dt_Standardize_u16p15b0")
Gs16_trqRefTqAlgnVal_C = Simulink.Parameter(0.2, StorageClass="ImportFromFile", HeaderFile="motor_control_param.h", DataType="dt_Standardize_s16p15b0", Min=-0.99997, Max=0.99997)
Gs16_nMaxRefMechSpd_C = Simulink.Parameter(0.15258789, StorageClass="ImportFromFile", HeaderFile="motor_control_param.h", DataType="dt_Standardize_s16p15b0")
Gs16_nMotoTmpStallRefMechSpd_C = Simulink.Parameter(0.15258789, StorageClass="ImportFromFile", HeaderFile="motor_control_param.h", DataType="dt_Standardize_s16p15b0")
Gu16_uComDiaDisblLoLvlRcvyTrs_C = Simulink.Parameter(0.1484375, StorageClass="ImportFromFile", HeaderFile="motor_control_param.h", DataType="dt_Standardize_u16p15b0")
Gu16_uComDiaDisblLoLvlConfTrs_C = Simulink.Parameter(0.140625, StorageClass="ImportFromFile", HeaderFile="motor_control_param.h", DataType="dt_Standardize_u16p15b0")
Gu16_uCtlBrdVltgLoLvl1RcvyTrs_C = Simulink.Parameter(0.125, StorageClass="ImportFromFile", HeaderFile="motor_control_param.h", DataType="dt_Standardize_u16p15b0")
Gu16_uSplyVltgLoLvl1RcvyTrs_C = Simulink.Parameter(0.125, StorageClass="ImportFromFile", HeaderFile="motor_control_param.h", DataType="dt_Standardize_u16p15b0")
Gu16_uSplyVltgLoLvl2RcvyTrs_C = Simulink.Parameter(0.125, StorageClass="ImportFromFile", HeaderFile="motor_control_param.h", DataType="dt_Standardize_u16p15b0")
Gu16_uCtlBrdVltgLoLvl1ConfTrs_C = Simulink.Parameter(0.1171875, StorageClass="ImportFromFile", HeaderFile="motor_control_param.h", DataType="dt_Standardize_u16p15b0")
Gu16_uSplyVltgLoLvl1ConfTrs_C = Simulink.Parameter(0.1171875, StorageClass="ImportFromFile", HeaderFile="motor_control_param.h", DataType="dt_Standardize_u16p15b0")
Gu16_uSplyVltgLoLvl2ConfTrs_C = Simulink.Parameter(0.1171875, StorageClass="ImportFromFile", HeaderFile="motor_control_param.h", DataType="dt_Standardize_u16p15b0")
Gu16_indQaxIndc_C = Simulink.Parameter(0.107, StorageClass="ImportFromFile", HeaderFile="motor_param.h", DataType="dt_Standardize_u16p15b0")  % 2.14E-5
Gu16_facDrtnVltgFltCoeff_C = Simulink.Parameter(0.1, StorageClass="ImportFromFile", HeaderFile="motor_control_param.h", DataType="fixdt(0,16,2^-17,0)")
Gu16_facSpdFltCoeff_C = Simulink.Parameter(0.1, StorageClass="ImportFromFile", HeaderFile="motor_control_param.h", DataType="fixdt(0,16,2^-17,0)")

Gu16_facDaxCurrCtlKp_C = Simulink.Parameter(0.1, StorageClass="ImportFromFile", HeaderFile="motor_control_param.h", DataType="dt_CurrCtrlPropGain_u16p15b0")  % The proportional gain is computed according to the following formula:
  % DirCurrCtrlKp = DirIndct / DirCurrRaisTime
  % where DirCurrRaisTime (1e-4[s]) is the raise time choosen for the direct current loop.
  % 0.029607476635514017
  % 0.176
  % 13199999999999998
  % 082242990654205608
  % 0.032897196261682242
  % 0.016448598130841121
  % 0.035528971962616812
  % 0.06
  % 0.1

Gu16_facQaxCurrCtlKp_C = Simulink.Parameter(0.1, StorageClass="ImportFromFile", HeaderFile="motor_control_param.h", DataType="dt_CurrCtrlPropGain_u16p15b0")  % The proportional gain is computed according to the following formula:
  % QdrtCurrCtrlKp = QdrtIndct / QdrCurrRaisTime
  % where QdrCurrRaisTime (1e-4[s]) is the raise time choosen for the quadrature current loop.
  % 0.10271999999999999
  % 0.051359999999999996

Gu16_resPhRstn_C = Simulink.Parameter(0.0965, StorageClass="ImportFromFile", HeaderFile="motor_param.h", DataType="dt_Standardize_u16p15b0")  % 0.0193
Gu16_indDaxIndc_C = Simulink.Parameter(0.088, StorageClass="ImportFromFile", HeaderFile="motor_param.h", DataType="dt_Standardize_u16p15b0")  % 1.76E-5
Gs16_nLmpHmeRefMechSpd_C = Simulink.Parameter(0.07629395, StorageClass="ImportFromFile", HeaderFile="motor_control_param.h", DataType="dt_Standardize_s16p15b0")
Gs16_nUDS2FRefMechSpd_C = Simulink.Parameter(0.0762939, StorageClass="ImportFromFile", HeaderFile="motor_control_param.h", DataType="dt_Standardize_s16p15b0")
Gs16_nOpnLpConvActElecSpd_C = Simulink.Parameter(0.06396484, StorageClass="ImportFromFile", HeaderFile="motor_control_param.h", DataType="dt_Standardize_s16p15b0")
Gs16_nMaxStrtUpRefElecSpd_C = Simulink.Parameter(0.05126953, StorageClass="ImportFromFile", HeaderFile="motor_control_param.h", DataType="dt_Standardize_s16p15b0")  % 210
Gs16_nMinSenlRefElecSpd_C = Simulink.Parameter(0.05126953, StorageClass="ImportFromFile", HeaderFile="motor_control_param.h", DataType="dt_Standardize_s16p15b0")  % 210
Gu16_rPhCurrADCRat_C = Simulink.Parameter(0.05, StorageClass="ImportFromFile", HeaderFile="motor_control_param.h", DataType="dt_MotRstn_u16p20b0")  % 0.0001953125
Gs16_nSenlTrnsElecSpd_C = Simulink.Parameter(0.04, StorageClass="ImportFromFile", HeaderFile="motor_control_param.h", DataType="dt_Standardize_s16p15b0")
Gs16_nMinStrtUpElecSpd_C = Simulink.Parameter(0.03833, StorageClass="ImportFromFile", HeaderFile="motor_control_param.h", DataType="dt_Standardize_s16p15b0")  % 157.07963267948966
Gs16_nShOffActElecSpd_C = Simulink.Parameter(0.03198242, StorageClass="ImportFromFile", HeaderFile="motor_control_param.h", DataType="dt_Standardize_s16p15b0")
Gu16_psiPermMagFlx_C = Simulink.Parameter(0.02583, StorageClass="ImportFromFile", HeaderFile="motor_param.h", DataType="dt_Standardize_u16p15b0")  % 0.0015497207641601563
Gs16_nMaxMotoSpdDvtConfTrs_C = Simulink.Parameter(0.02556641, StorageClass="ImportFromFile", HeaderFile="motor_control_param.h", DataType="dt_Standardize_s16p15b0")
Gs16_nStrtUpProcTolcElecSpd_C = Simulink.Parameter(0.02539, StorageClass="ImportFromFile", HeaderFile="motor_control_param.h", DataType="dt_Standardize_s16p15b0")
Gs16_nMotoStallMinRefElecSpd_C = Simulink.Parameter(0.02441406, StorageClass="ImportFromFile", HeaderFile="motor_control_param.h", DataType="dt_Standardize_s16p15b0")
Gs16_nMinMotoSpdDvtRcvyTrs_C = Simulink.Parameter(0.0127832, StorageClass="ImportFromFile", HeaderFile="motor_control_param.h", DataType="dt_Standardize_s16p15b0")
Gs16_nMotoStallMinActElecSpd_C = Simulink.Parameter(0.01220703, StorageClass="ImportFromFile", HeaderFile="motor_control_param.h", DataType="dt_Standardize_s16p15b0")
Gs16_uRefQaxVltg_C = Simulink.Parameter(0.01, StorageClass="ImportFromFile", HeaderFile="motor_control_param.h", DataType="dt_Standardize_s16p15b0", Min=-0.99997, Max=0.99997)
Gu16_facFlxObsFltCoeff_C = Simulink.Parameter(0.01, StorageClass="ImportFromFile", HeaderFile="motor_control_param.h", DataType="fixdt(0,16,2^-17,0)")
Gs16_nMinRefMechSpd_C = Simulink.Parameter(0.00305176, StorageClass="ImportFromFile", HeaderFile="motor_control_param.h", DataType="dt_Standardize_s16p15b0")
Gs16_nAlgnRefElecSpd_C = Simulink.Parameter(0.00153398, StorageClass="ImportFromFile", HeaderFile="motor_control_param.h", DataType="dt_Standardize_s16p15b0")  % 6.2831853071795862
Gu16_rSplyVltgADCRat_C = Simulink.Parameter(0.001, StorageClass="ImportFromFile", HeaderFile="motor_control_param.h", DataType="dt_VltgRat_u16p22b0")
Gu16_rCtlBrdVltgADCRat_C = Simulink.Parameter(0.001, StorageClass="ImportFromFile", HeaderFile="motor_control_param.h", DataType="dt_VltgRat_u16p22b0")
Gu16_rGDVltgADCRat_C = Simulink.Parameter(0.001, StorageClass="ImportFromFile", HeaderFile="motor_control_param.h", DataType="dt_VltgRat_u16p22b0")
Gs16_tiSenlElecAgDel_C = Simulink.Parameter(0, StorageClass="ImportFromFile", HeaderFile="motor_control_param.h", DataType="fixdt(1,16,2^-21,0)")
Gs16_trqInitCondTq_C = Simulink.Parameter(0, StorageClass="ImportFromFile", HeaderFile="motor_control_param.h", DataType="dt_Standardize_s16p15b0")  % 0.1
Gu16_phiAlgnBePhElecAg_C = Simulink.Parameter(0, StorageClass="ImportFromFile", HeaderFile="motor_control_param.h", DataType="dt_RadAng_u16r15b0", Min=0, Max=6.28309)
Gbol_enLmpHmeStop_C = Simulink.Parameter(0, StorageClass="ImportFromFile", HeaderFile="motor_control_param.h", DataType="boolean")
Gbol_enFaltInfoManClr_C = Simulink.Parameter(0, StorageClass="ImportFromFile", HeaderFile="motor_control_param.h", DataType="boolean")
Gu16_ctSenlTrnsElecAgRcvyCnt_C = Simulink.Parameter(0, StorageClass="ImportFromFile", HeaderFile="motor_control_param.h", DataType="uint16")
Gs16_iPhCurrLim_CUR = Simulink.Parameter([0.247 0.247 0.2473 0.2226 0.04297 0], StorageClass="ImportFromFile", HeaderFile="motor_control_param.h", DataType="dt_Standardize_s16p15b0")
Gs16_iNoLdPhCurr_CUR = Simulink.Parameter([0.05 0.12 0.2 0.3 0.4], StorageClass="ImportFromFile", HeaderFile="motor_control_param.h", DataType="dt_Standardize_s16p15b0")
Gs16_iSplyCurrTempLim_CUR = Simulink.Parameter(repmat(0.1, 1, 6), StorageClass="ImportFromFile", HeaderFile="motor_control_param.h", DataType="dt_Standardize_s16p15b0")
Gu16_tPwrTubTemp_CUR_ADPwrTubTempADC_X = Simulink.Parameter([0 500 1000 1500 2000], StorageClass="ImportFromFile", HeaderFile="motor_control_param.h", DataType="uint16")
Gu16_tMotoTemp_CUR_ADMotoTempADC_X = Simulink.Parameter([0 500 1000 1500 2000], StorageClass="ImportFromFile", HeaderFile="motor_control_param.h", DataType="uint16")
Gu16_tPCBTemp_CUR_ADPCBTempADC_X = Simulink.Parameter([0 100 200 300 400 500 600 700 800 900 1000 1100 1200 1300 1400 1500 1600 1700 1800 1900 2000 2100 2200 2300 2400 2500 2600 2700 2800 2900 3000 3100 3200 3300 3400 3500 3600 3700], StorageClass="ImportFromFile", HeaderFile="motor_control_param.h", DataType="uint16")
Gu8_tPwrTubTemp_CUR = Simulink.Parameter([0 20 40 80 120], StorageClass="ImportFromFile", HeaderFile="motor_control_param.h", DataType="dt_Temp_u8p0bn40")
Gs16_iNoLdPhCurr_CUR_nActElecSpd_X = Simulink.Parameter([0 0.122 0.24414 0.36621 0.48828], StorageClass="ImportFromFile", HeaderFile="motor_control_param.h", DataType="dt_Standardize_s16p15b0")
Gs16_iPhCurrLim_CUR_tPCBTemp_X = Simulink.Parameter([-40 0 110 122 146 160], StorageClass="ImportFromFile", HeaderFile="motor_control_param.h", DataType="dt_Temp_u8p0bn40")
Gu8_tMotoTemp_CUR = Simulink.Parameter([-40 0 40 80 120], StorageClass="ImportFromFile", HeaderFile="motor_control_param.h", DataType="dt_Temp_u8p0bn40")
Gs16_iSplyCurrTempLim_CUR_tPCBTemp_X = Simulink.Parameter([-40 0 40 80 105 120], StorageClass="ImportFromFile", HeaderFile="motor_control_param.h", DataType="dt_Temp_u8p0bn40")
Gu8_tPCBTemp_CUR = Simulink.Parameter([-40 -36 -32 -28 -24 -20 -16 -12 -8 -4 0 4 8 12 16 20 24 28 32 36 40 44 48 52 56 60 64 68 72 76 80 84 88 92 96 100 104 108], StorageClass="ImportFromFile", HeaderFile="motor_control_param.h", DataType="dt_Temp_u8p0bn40")
Gs16_tCtlVltgDelTi_C = Simulink.Parameter(-0.0002, StorageClass="ImportFromFile", HeaderFile="motor_control_param.h", DataType="fixdt(1,16,2^-21,0)")
Gs16_facRefSpdFallSlwRate_C = Simulink.Parameter(-2, StorageClass="ImportFromFile", HeaderFile="motor_control_param.h", DataType="dt_RefSpdSlewRate_s16p12b0")  % -2.44
Gs16_facAlgnTqFallRate_C = Simulink.Parameter(-2.325, StorageClass="ImportFromFile", HeaderFile="motor_control_param.h", DataType="fixdt(1,16,2^-9,0)")
Gu16_etaCtlBrd_MAP_nActElecSpd_Y = Simulink.Parameter([0.128 0.256 0.384 0.512 0.64 0.768], StorageClass="ImportFromFile", HeaderFile="motor_control_param.h", DataType="dt_Standardize_s16p15b0")
Gu16_etaCtlBrd_MAP = Simulink.Parameter(repmat(0.95, 6, 6), StorageClass="ImportFromFile", HeaderFile="motor_control_param.h", DataType="dt_Standardize_u16p15b0")
Gu16_etaCtlBrd_MAP_ampActPhCurrAmp_X = Simulink.Parameter([0.045 0.09 0.135 0.18 0.225 0.27], StorageClass="ImportFromFile", HeaderFile="motor_control_param.h", DataType="dt_Standardize_s16p15b0")
Genm_modeAgEvallMode_C = Simulink.Parameter(ENM_AG_POS_EVAL_MODE.SENSOR, StorageClass="ImportFromFile", HeaderFile="motor_control_param.h", DataType="Enum: ENM_AG_POS_EVAL_MODE")
Gu16_uCtlBrdVltgHiLvl1ConfTrs_C = Simulink.Parameter(0.2890625, StorageClass="ImportFromFile", HeaderFile="motor_control_param.h", DataType="dt_Standardize_u16p15b0")
Gs16_iPhCurrHiLvl1RcvyTrs_C = Simulink.Parameter(0.246, StorageClass="ImportFromFile", HeaderFile="motor_control_param.h", DataType="dt_Standardize_s16p15b0")
Gs16_iPhCurrHiLvl1ConfTrs_C = Simulink.Parameter(0.2734, StorageClass="ImportFromFile", HeaderFile="motor_control_param.h", DataType="dt_Standardize_s16p15b0")
Gu16_nMotoSpdHiLvl1ConfTrs_C = Simulink.Parameter(0.703, StorageClass="ImportFromFile", HeaderFile="motor_control_param.h", DataType="dt_Standardize_s16p15b0")
Gu16_nMotoSpdHiLvl1RcvyTrs_C = Simulink.Parameter(0.65194, StorageClass="ImportFromFile", HeaderFile="motor_control_param.h", DataType="dt_Standardize_s16p15b0")
Gu16_uLimHmeSplyVltgConfTrs_C = Simulink.Parameter(0.203125, StorageClass="ImportFromFile", HeaderFile="motor_control_param.h", DataType="dt_Standardize_u16p15b0")
Gu16_uLimHmeSplyVltgRcvyTrs_C = Simulink.Parameter(0.1875, StorageClass="ImportFromFile", HeaderFile="motor_control_param.h", DataType="dt_Standardize_u16p15b0")
Gu8_tMaxNTCMCUTempDvt_C = Simulink.Parameter(50, StorageClass="ImportFromFile", HeaderFile="motor_control_param.h", DataType="dt_Temp_u8p0bn40")
Gu8_tNTCTempSensOpnCir_C = Simulink.Parameter(-15, StorageClass="ImportFromFile", HeaderFile="motor_control_param.h", DataType="dt_Temp_u8p0bn40")
Gs16_facRefSpdOLFallSlwRate_C = Simulink.Parameter(-0.1, StorageClass="ImportFromFile", HeaderFile="motor_control_param.h", DataType="dt_RefSpdSlewRate_s16p12b0")  % 2.44
Gs16_facRefSpdOLRiseSlwRate_C = Simulink.Parameter(0.1, StorageClass="ImportFromFile", HeaderFile="motor_control_param.h", DataType="dt_RefSpdSlewRate_s16p12b0")  % 2.44
Gu16_psiEstMinPermMagFlx_C = Simulink.Parameter(0.002, StorageClass="ImportFromFile", HeaderFile="motor_control_param.h", DataType="dt_Standardize_u16p15b0")
Gu16_uADPwrTubTempFaltLoLim_C = Simulink.Parameter(100, StorageClass="ImportFromFile", HeaderFile="motor_control_param.h", DataType="uint16")
Gu16_uADPCBTempFaltLoLim_C = Simulink.Parameter(100, StorageClass="ImportFromFile", HeaderFile="motor_control_param.h", DataType="uint16")
Gu16_ctPwrTubTempFaltConfCnt_C = Simulink.Parameter(100, StorageClass="ImportFromFile", HeaderFile="motor_control_param.h", DataType="uint16")
Gu16_ctPwrTubTempFaltRcvyCnt_C = Simulink.Parameter(100, StorageClass="ImportFromFile", HeaderFile="motor_control_param.h", DataType="uint16")
Gu16_ctPCBTempFaltConfCnt_C = Simulink.Parameter(100, StorageClass="ImportFromFile", HeaderFile="motor_control_param.h", DataType="uint16")
Gu16_ctPCBTempFaltRcvyCnt_C = Simulink.Parameter(100, StorageClass="ImportFromFile", HeaderFile="motor_control_param.h", DataType="uint16")
Gu8_ctInitDisblCnt_C = Simulink.Parameter(150, StorageClass="ImportFromFile", HeaderFile="motor_control_param.h", DataType="uint8")
Gu16_ctComDiaDisblHiLvlConfCnt_C = Simulink.Parameter(0, StorageClass="ImportFromFile", HeaderFile="motor_control_param.h", DataType="uint16")
Gu16_ctComDiaDisblHiLvlRcvyCnt_C = Simulink.Parameter(50, StorageClass="ImportFromFile", HeaderFile="motor_control_param.h", DataType="uint16")
Gu16_ctComDiaDisblLoLvlRcvyCnt_C = Simulink.Parameter(50, StorageClass="ImportFromFile", HeaderFile="motor_control_param.h", DataType="uint16")
Gu16_ctComDiaDisblLoLvlConfCnt_C = Simulink.Parameter(0, StorageClass="ImportFromFile", HeaderFile="motor_control_param.h", DataType="uint16")
Gu16_ctCtlBrdVltgLoLvl1RcvyCnt_C = Simulink.Parameter(100, StorageClass="ImportFromFile", HeaderFile="motor_control_param.h", DataType="uint16")
Gu16_ctCtlBrdVltgLoLvl1ConfCnt_C = Simulink.Parameter(100, StorageClass="ImportFromFile", HeaderFile="motor_control_param.h", DataType="uint16")
Gu16_ctCtlBrdVltgHiLvl1ConfCnt_C = Simulink.Parameter(100, StorageClass="ImportFromFile", HeaderFile="motor_control_param.h", DataType="uint16")
Gu16_ctCtlBrdVltgHiLvl1RcvyCnt_C = Simulink.Parameter(100, StorageClass="ImportFromFile", HeaderFile="motor_control_param.h", DataType="uint16")
Gu16_ctPhCurrHiLvl1ConfCnt_C = Simulink.Parameter(100, StorageClass="ImportFromFile", HeaderFile="motor_control_param.h", DataType="uint16")
Gu16_ctPhCurrHiLvl1RcvyCnt_C = Simulink.Parameter(100, StorageClass="ImportFromFile", HeaderFile="motor_control_param.h", DataType="uint16")
Gu16_ctHWOvrCurrConfCnt_C = Simulink.Parameter(103, StorageClass="ImportFromFile", HeaderFile="motor_control_param.h", DataType="uint16")
Gu16_ctHWOvrCurrRcvyCnt_C = Simulink.Parameter(103, StorageClass="ImportFromFile", HeaderFile="motor_control_param.h", DataType="uint16")
Gu16_ctSplyVltgLoLvl1RcvyCnt_C = Simulink.Parameter(100, StorageClass="ImportFromFile", HeaderFile="motor_control_param.h", DataType="uint16")
Gu16_ctSplyVltgLoLvl1ConfCnt_C = Simulink.Parameter(100, StorageClass="ImportFromFile", HeaderFile="motor_control_param.h", DataType="uint16")
Gu16_ctSplyVltgLoLvl2RcvyCnt_C = Simulink.Parameter(100, StorageClass="ImportFromFile", HeaderFile="motor_control_param.h", DataType="uint16")
Gu16_ctSplyVltgLoLvl2ConfCnt_C = Simulink.Parameter(100, StorageClass="ImportFromFile", HeaderFile="motor_control_param.h", DataType="uint16")
Gu16_ctSplyVltgHiLvl1ConfCnt_C = Simulink.Parameter(100, StorageClass="ImportFromFile", HeaderFile="motor_control_param.h", DataType="uint16")
Gu16_ctSplyVltgHiLvl1RcvyCnt_C = Simulink.Parameter(100, StorageClass="ImportFromFile", HeaderFile="motor_control_param.h", DataType="uint16")
Gu16_ctGDVltgLoLvl1ConfCnt_C = Simulink.Parameter(100, StorageClass="ImportFromFile", HeaderFile="motor_control_param.h", DataType="uint16")
Gu16_ctGDVltgLoLvl1RcvyCnt_C = Simulink.Parameter(100, StorageClass="ImportFromFile", HeaderFile="motor_control_param.h", DataType="uint16")
Gu16_ctGDVltgHiLvl1ConfCnt_C = Simulink.Parameter(100, StorageClass="ImportFromFile", HeaderFile="motor_control_param.h", DataType="uint16")
Gu16_ctGDVltgHiLvl1RcvyCnt_C = Simulink.Parameter(100, StorageClass="ImportFromFile", HeaderFile="motor_control_param.h", DataType="uint16")
Gu16_ctCrashFaltConfCnt_C = Simulink.Parameter(5, StorageClass="ImportFromFile", HeaderFile="motor_control_param.h", DataType="uint16")
Gu16_ctCrashFaltRcvyCnt_C = Simulink.Parameter(0, StorageClass="ImportFromFile", HeaderFile="motor_control_param.h", DataType="uint16")
Gu16_ctPhiSensFaltConfCnt_C = Simulink.Parameter(0, StorageClass="ImportFromFile", HeaderFile="motor_control_param.h", DataType="uint16")
Gu16_ctPhiSensFaltRcvyCnt_C = Simulink.Parameter(0, StorageClass="ImportFromFile", HeaderFile="motor_control_param.h", DataType="uint16")
Gu16_ctPhCurrSensFaltConfCnt_C = Simulink.Parameter(100, StorageClass="ImportFromFile", HeaderFile="motor_control_param.h", DataType="uint16")
Gu16_ctPhCurrSensFaltRcvyCnt_C = Simulink.Parameter(100, StorageClass="ImportFromFile", HeaderFile="motor_control_param.h", DataType="uint16")
Gu16_ctBusOffFaltConfCnt_C = Simulink.Parameter(3, StorageClass="ImportFromFile", HeaderFile="motor_control_param.h", DataType="uint16")
Gu16_ctBusOffFaltRcvyCnt_C = Simulink.Parameter(0, StorageClass="ImportFromFile", HeaderFile="motor_control_param.h", DataType="uint16")
Gu16_ctChipFaltConfCnt_C = Simulink.Parameter(100, StorageClass="ImportFromFile", HeaderFile="motor_control_param.h", DataType="uint16")
Gu16_ctChipFaltRcvyCnt_C = Simulink.Parameter(100, StorageClass="ImportFromFile", HeaderFile="motor_control_param.h", DataType="uint16")
Gu16_ctPwrTubTempHiLvl1ConfCnt_C = Simulink.Parameter(100, StorageClass="ImportFromFile", HeaderFile="motor_control_param.h", DataType="uint16")
Gu16_ctPwrTubTempHiLvl1RcvyCnt_C = Simulink.Parameter(100, StorageClass="ImportFromFile", HeaderFile="motor_control_param.h", DataType="uint16")
Gu16_ctPCBTempHiLvl1ConfCnt_C = Simulink.Parameter(100, StorageClass="ImportFromFile", HeaderFile="motor_control_param.h", DataType="uint16")
Gu16_ctPCBTempHiLvl1RcvyCnt_C = Simulink.Parameter(100, StorageClass="ImportFromFile", HeaderFile="motor_control_param.h", DataType="uint16")
Gu16_ctPwrTubTempHiLvl2ConfCnt_C = Simulink.Parameter(100, StorageClass="ImportFromFile", HeaderFile="motor_control_param.h", DataType="uint16")
Gu16_ctPwrTubTempHiLvl2RcvyCnt_C = Simulink.Parameter(100, StorageClass="ImportFromFile", HeaderFile="motor_control_param.h", DataType="uint16")
Gu16_ctPCBTempHiLvl2ConfCnt_C = Simulink.Parameter(100, StorageClass="ImportFromFile", HeaderFile="motor_control_param.h", DataType="uint16")
Gu16_ctPCBTempHiLvl2RcvyCnt_C = Simulink.Parameter(100, StorageClass="ImportFromFile", HeaderFile="motor_control_param.h", DataType="uint16")
Gu16_ctMotoTempHiLvl1ConfCnt_C = Simulink.Parameter(100, StorageClass="ImportFromFile", HeaderFile="motor_control_param.h", DataType="uint16")
Gu16_ctMotoTempHiLvl1RcvyCnt_C = Simulink.Parameter(100, StorageClass="ImportFromFile", HeaderFile="motor_control_param.h", DataType="uint16")
Gu16_ctMotoTempHiLvl2RcvyCnt_C = Simulink.Parameter(100, StorageClass="ImportFromFile", HeaderFile="motor_control_param.h", DataType="uint16")
Gu16_ctMotoTempHiLvl2ConfCnt_C = Simulink.Parameter(100, StorageClass="ImportFromFile", HeaderFile="motor_control_param.h", DataType="uint16")
Gu16_ctComLosFaltConfCnt_C = Simulink.Parameter(5, StorageClass="ImportFromFile", HeaderFile="motor_control_param.h", DataType="uint16")
Gu16_ctComLosFaltRcvyCnt_C = Simulink.Parameter(5, StorageClass="ImportFromFile", HeaderFile="motor_control_param.h", DataType="uint16")
Gu16_ctComRolCntFaltConfCnt_C = Simulink.Parameter(3, StorageClass="ImportFromFile", HeaderFile="motor_control_param.h", DataType="uint16")
Gu16_ctComRolCntFaltRcvyCnt_C = Simulink.Parameter(0, StorageClass="ImportFromFile", HeaderFile="motor_control_param.h", DataType="uint16")
Gu16_ctCRCFaltConfCnt_C = Simulink.Parameter(5, StorageClass="ImportFromFile", HeaderFile="motor_control_param.h", DataType="uint16")
Gu16_ctCRCFaltRcvyCnt_C = Simulink.Parameter(0, StorageClass="ImportFromFile", HeaderFile="motor_control_param.h", DataType="uint16")
Gu16_ctMesgLngthFaltConfCnt_C = Simulink.Parameter(0, StorageClass="ImportFromFile", HeaderFile="motor_control_param.h", DataType="uint16")
Gu16_ctMesgLngthFaltRcvyCnt_C = Simulink.Parameter(0, StorageClass="ImportFromFile", HeaderFile="motor_control_param.h", DataType="uint16")
Gu16_ctMotoStallConfCnt_C = Simulink.Parameter(100, StorageClass="ImportFromFile", HeaderFile="motor_control_param.h", DataType="uint16")
Gu16_ctMotoStallRcvyCnt_C = Simulink.Parameter(100, StorageClass="ImportFromFile", HeaderFile="motor_control_param.h", DataType="uint16")
Gu16_ctNoLdConfCnt_C = Simulink.Parameter(100, StorageClass="ImportFromFile", HeaderFile="motor_control_param.h", DataType="uint16")
Gu16_ctNoLdRcvyCnt_C = Simulink.Parameter(100, StorageClass="ImportFromFile", HeaderFile="motor_control_param.h", DataType="uint16")
Gu16_ctBattPwrHiLvl1ConfCnt_C = Simulink.Parameter(100, StorageClass="ImportFromFile", HeaderFile="motor_control_param.h", DataType="uint16")
Gu16_ctBattPwrHiLvl1RcvyCnt_C = Simulink.Parameter(100, StorageClass="ImportFromFile", HeaderFile="motor_control_param.h", DataType="uint16")
Gu16_ctMotoSpdHiLvl1ConfCnt_C = Simulink.Parameter(100, StorageClass="ImportFromFile", HeaderFile="motor_control_param.h", DataType="uint16")
Gu16_ctMotoSpdHiLvl1RcvyCnt_C = Simulink.Parameter(100, StorageClass="ImportFromFile", HeaderFile="motor_control_param.h", DataType="uint16")
Gu16_ctMotoTempFaltConfCnt_C = Simulink.Parameter(100, StorageClass="ImportFromFile", HeaderFile="motor_control_param.h", DataType="uint16")
Gu16_ctMotoTempFaltRcvyCnt_C = Simulink.Parameter(100, StorageClass="ImportFromFile", HeaderFile="motor_control_param.h", DataType="uint16")
Gu16_uGDVltgHiLvl1ConfTrs_C = Simulink.Parameter(0.2890625, StorageClass="ImportFromFile", HeaderFile="motor_control_param.h", DataType="dt_Standardize_u16p15b0")
Gu16_uGDVltgHiLvl1RcvyTrs_C = Simulink.Parameter(0.28125, StorageClass="ImportFromFile", HeaderFile="motor_control_param.h", DataType="dt_Standardize_u16p15b0")
Gu16_uGDVltgLoLvl1RcvyTrs_C = Simulink.Parameter(0.125, StorageClass="ImportFromFile", HeaderFile="motor_control_param.h", DataType="dt_Standardize_u16p15b0")
Gu16_uGDVltgLoLvl1ConfTrs_C = Simulink.Parameter(0.1171875, StorageClass="ImportFromFile", HeaderFile="motor_control_param.h", DataType="dt_Standardize_u16p15b0")
Gu16_uADMotoTempFaltHiLim_C = Simulink.Parameter(4000, StorageClass="ImportFromFile", HeaderFile="motor_control_param.h", DataType="uint16")
Gu16_uADMotoTempFaltLoLim_C = Simulink.Parameter(100, StorageClass="ImportFromFile", HeaderFile="motor_control_param.h", DataType="uint16")
Gu16_stCtlDFPMSt_C = Simulink.Parameter([0 0 0 15 0 0 0 0 0 0 0 0 0 0 0 0 0 0 0 0 0 15 0 0 0 13 0 0 0 0], StorageClass="ImportFromFile", HeaderFile="motor_control_param.h", DataType="uint16")
Gs16_nNoLdJudgActElecSpd_C = Simulink.Parameter(0.51133, StorageClass="ImportFromFile", HeaderFile="motor_control_param.h", DataType="dt_Standardize_s16p15b0")
Gu8_tNTCTempSensNoOpnCir_C = Simulink.Parameter(-15, StorageClass="ImportFromFile", HeaderFile="motor_control_param.h", DataType="dt_Temp_u8p0bn40")
Gs16_tiPhVltgAgDel_C = Simulink.Parameter(0, StorageClass="ImportFromFile", HeaderFile="motor_control_param.h", DataType="fixdt(1,16,2^-21,0)")

Gu16_facPLLCtlKp_MAP = Simulink.Parameter(repmat(30, 4, 4), StorageClass="ImportFromFile", HeaderFile="motor_control_param.h", DataType="fixdt(0,16,2^-6,0)")  % The proportional gain is computed according to the following formula:
  % DirCurrCtrlKp = DirIndct / DirCurrRaisTime
  % where DirCurrRaisTime (1e-4[s]) is the raise time choosen for the direct current loop.
  % 0.029607476635514017
  % 0.176
  % 13199999999999998
  % 082242990654205608
  % 0.032897196261682242
  % 0.016448598130841121
  % 0.035528971962616812
  % 0.06
  % 100
  % 5

Gu8_facPLLCtlKp_MAP_tPCBTempSubs_X = Simulink.Parameter([-40 0 40 90], StorageClass="ImportFromFile", HeaderFile="motor_control_param.h", DataType="dt_Temp_u8p0bn40")  % The proportional gain is computed according to the following formula:
  % DirCurrCtrlKp = DirIndct / DirCurrRaisTime
  % where DirCurrRaisTime (1e-4[s]) is the raise time choosen for the direct current loop.
  % 0.029607476635514017
  % 0.176
  % 13199999999999998
  % 082242990654205608
  % 0.032897196261682242
  % 0.016448598130841121
  % 0.035528971962616812
  % 0.06
  % 100
  % 5

Gs16_facPLLCtlKp_MAP_nActElecSpd_Y = Simulink.Parameter([0.02 0.1 0.3 0.5], StorageClass="ImportFromFile", HeaderFile="motor_control_param.h", DataType="dt_Standardize_s16p15b0")  % The proportional gain is computed according to the following formula:
  % DirCurrCtrlKp = DirIndct / DirCurrRaisTime
  % where DirCurrRaisTime (1e-4[s]) is the raise time choosen for the direct current loop.
  % 0.029607476635514017
  % 0.176
  % 13199999999999998
  % 082242990654205608
  % 0.032897196261682242
  % 0.016448598130841121
  % 0.035528971962616812
  % 0.06
  % 100
  % 5

Gu16_facPLLCtlKi_MAP = Simulink.Parameter(repmat(50, 4, 4), StorageClass="ImportFromFile", HeaderFile="motor_control_param.h", DataType="fixdt(0,16,2^-6,0)")  % The integral gain for direct current PI is computed in order to get a behaviour like a 1st order system:
  % DirCurrCtrlKi = DirCurrCtrlKp * (AmbPhsRstn/DirIndct)
  % 193
  % 96.5
  % 900
  % 50

Gs16_trqMaxStrtUpTq_C = Simulink.Parameter(0.5, StorageClass="ImportFromFile", HeaderFile="motor_control_param.h", DataType="dt_Standardize_s16p15b0")  % 0.2
Gs16_facStrtUpTrqDecRiseRate_C = Simulink.Parameter(0.5, StorageClass="ImportFromFile", HeaderFile="motor_control_param.h", DataType="fixdt(1,16,2^-9,0)")  % 2.44
Gs16_facStrtUpTrqDecFallRate_C = Simulink.Parameter(-0.5, StorageClass="ImportFromFile", HeaderFile="motor_control_param.h", DataType="fixdt(1,16,2^-9,0)")  % 2.44
Gu16_phiMinOpnLpClsLpAgDvt_C = Simulink.Parameter(0.3, StorageClass="ImportFromFile", HeaderFile="motor_control_param.h", DataType="dt_RadAng_u16r15b0")  % 2.44

Gs16_trqMinStrtUpRefTq_C = Simulink.Parameter(0.02, StorageClass="ImportFromFile", HeaderFile="motor_control_param.h", DataType="dt_Standardize_s16p15b0")  % The integral gain for direct current PI is computed in order to get a behaviour like a 1st order system:
  % DirCurrCtrlKi = DirCurrCtrlKp * (AmbPhsRstn/DirIndct)
  % 193
  % 96.5
  % 900

Gu16_facComSpdFltCoeff_C = Simulink.Parameter(0.1, StorageClass="ImportFromFile", HeaderFile="motor_control_param.h", DataType="fixdt(0,16,2^-17,0)")
Gu16_ctMosOpnCirFaltConfCnt_C = Simulink.Parameter(5, StorageClass="ImportFromFile", HeaderFile="motor_control_param.h", DataType="uint16")
Gu16_ctMosOpnCirFaltRcvyCnt_C = Simulink.Parameter(0, StorageClass="ImportFromFile", HeaderFile="motor_control_param.h", DataType="uint16")
Gu8_tColdStrtPCBTempConfTrs_C = Simulink.Parameter(10, StorageClass="ImportFromFile", HeaderFile="motor_control_param.h", DataType="dt_Temp_u8p0bn40")
Gs16_iColdStrtPhCurrHiLvl1ConfTrs_C = Simulink.Parameter(0.3125, StorageClass="ImportFromFile", HeaderFile="motor_control_param.h", DataType="dt_Standardize_s16p15b0")
Gs16_iColdStrtPhCurrHiLvl1RcvyTrs_C = Simulink.Parameter(0.246, StorageClass="ImportFromFile", HeaderFile="motor_control_param.h", DataType="dt_Standardize_s16p15b0")
Gs16_iSplyCurrVltgLim_CUR_uSplyVltg_X = Simulink.Parameter([0.05 0.0953125 0.140625 0.2 0.25 0.289 0.34375], StorageClass="ImportFromFile", HeaderFile="motor_control_param.h", DataType="dt_Standardize_u16p15b0")
Gs16_iSplyCurrVltgLim_CUR = Simulink.Parameter([0.0292 0.1 0.1 0.1 0.1 0.0256 0], StorageClass="ImportFromFile", HeaderFile="motor_control_param.h", DataType="dt_Standardize_s16p15b0")
Gs16_trqTmpStallTqUpLim_C = Simulink.Parameter(0.5, StorageClass="ImportFromFile", HeaderFile="motor_control_param.h", DataType="dt_Standardize_s16p15b0")