% Simulink data dictionary dd_model_parameter.sldd

parMotRtrInrt = Simulink.Parameter(1.652e-5)
parMotTorsViscDamp = Simulink.Parameter(7.957747e-05)
parGmrSensAngErrInpData = Simulink.Parameter([0; 1; 2; 3; 4; 5; 6; 7; 8; 9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 360], DataType="double")
parGmrSensAngErrLktData = Simulink.Parameter([-0.05; -0.05; -0.05; -0.04; -0.04; -0.04; -0.03; -0.03; -0.03; -0.03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 -0.05], DataType="double")
cstPhsRsntTempCoef = Simulink.Parameter(0.00393, DataType="fixdt(1,16,2^-21,0)")
cstPermMagTempCoef = Simulink.Parameter(-0.0012, DataType="fixdt(1,16,2^-23,0)")