% Simulink data dictionary dd_platform_parameter.sldd
% references dd_model_parameter.sldd
% references dd_foc_dictionary.sldd

parElctAccMaxVal = Simulink.Parameter(32767, DataType="double")  % Maximum electric acceleration
parMaxOperTrq = Simulink.Parameter(0.8)
parMinOperTrq = Simulink.Parameter(0)
parFastTaskMaxSampTime = Simulink.Parameter(0.000125)
parPwmSwtcFreq = Simulink.Parameter(16000, DataType="double")
slnum_sfix16_En3 = Simulink.NumericType(DataTypeMode="Fixed-point: binary point scaling", SignednessBool=true, WordLength=16, FixedExponent=-3)
cstPhsCurrMaxValCopy = Simulink.Parameter(100, DataType="double")
cstPhsCurrMaxValCopy1 = Simulink.Parameter(100, DataType="double")

cfg_FocCodeGeneration_v01 = Simulink.ConfigSet(StartTime="0", StopTime="5", FixedStep="6.25e-6", Solver="ode8", ProdHWDeviceType="ARM Compatible->ARM Cortex-M", SystemTargetFile="ert.tlc", TargetLang="C")  % This code generation setting allows to generate tasks with input and output data
  % grouped as structures.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

cfg_FocCodeGeneration_v03 = Simulink.ConfigSet(StartTime="0", StopTime="5", RelTol="1e-3", Solver="ode45", ProdHWDeviceType="ARM Compatible->ARM Cortex-M", SystemTargetFile="ert.tlc", TargetLang="C")  % This code generation setting allows to generate tasks with input and output data
  % represented as arguments of a function.
  % Sinchronization between tasks has been removed.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

cfg_FocCodeGeneration_v02 = Simulink.ConfigSet(StartTime="0", StopTime="5", FixedStep="6.25e-6", Solver="ode8", ProdHWDeviceType="ARM Compatible->ARM Cortex-M", SystemTargetFile="ert.tlc", TargetLang="C")  % This code generation setting allows to generate tasks with input and output data
  % represented as arguments of a function.
  % Inputs and outputs name does not inherit model name into their identifiers.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

cfg_FocCodeGeneration_v04 = Simulink.ConfigSet(StartTime="0", StopTime="40", RelTol="1e-3", Solver="ode45", ProdHWDeviceType="ARM Compatible->ARM Cortex-M", SystemTargetFile="ert.tlc", TargetLang="C")  % This code generation setting allows to generate tasks with input and output data
  % represented as arguments of a function.
  % Sinchronization between tasks has been removed.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