% Simulink data dictionary dd_discrete_time_integrator.sldd

parInpInitVal = Simulink.Parameter(0, DataType="parInpDataType")
parInitCondInitVal = Simulink.Parameter(0, DataType="parInpDataType")
parTestProcInitCondIndx = Simulink.Parameter(0, DataType="uint8")
parRsetCondInitVal = Simulink.Parameter(0, DataType="boolean")
parTestProcRsetCondIndx = Simulink.Parameter(0, DataType="uint8")
parTestProcUpLimIndx = Simulink.Parameter(0, DataType="uint8")
parTestProcLowLimIndx = Simulink.Parameter(0, DataType="uint8")
parSampTime = Simulink.Parameter(0.01, DataType="parSampTimeDataType")
parIntgGain = Simulink.Parameter(1, DataType="parIntgGainDataType")
parIntgGainDataType = Simulink.AliasType(BaseType="fixdt(0,16,10^-2,0)")
parSampTimeDataType = Simulink.AliasType(BaseType="fixdt(0,16,10^-4,0)")
parInpDataType = Simulink.AliasType(BaseType="fixdt(1,16,2^-8,0)")
parTestProcInpIndx = Simulink.Parameter(1, DataType="uint8")
parAccmDataType = Simulink.AliasType(BaseType="fixdt(1,32,2^-26,0)")
parTestTol = Simulink.Parameter(0.001)
parLowLimInitVal = Simulink.Parameter(0, DataType="parInpDataType")
parUpLimInitVal = Simulink.Parameter(0, DataType="parInpDataType")
parSatFlag = Simulink.Parameter(0, DataType="boolean")
parOutpDataTypeInhrFlag = Simulink.Parameter(true, DataType="boolean")
parOutpDataTypeInhr = Simulink.AliasType(BaseType="fixdt(1,16,2^-10,0)")
parOutpDataType = Simulink.AliasType(BaseType="fixdt(1,16,2^-10,0)")