test file "tf_discrete_time_integrator"
  coverage: Decision, MCDC, SignalRange, SimulinkDesignVerifier, RelationalBoundary, Condition, LookupTable, SignalSize, SaturationOnIntOverflow

suite "smoke_test"

  case "test_case_1" [simulation]
    description: Scope
      This test shall check if the block integrates according to specified sampling time
      Parameters
      - Set Integral gain lb_parIntgGain to 1.0 with a predefined datatype for this parameter
      - Set output data type lb_parOutpDataType to Inherit: Inherit via back propagation
      - Disable Output saturation lb_bolSatFlag
      - Set sampling time lb_parSampTime to 0.02[s] with a predefined datatype for this parameter
      Test procedure
      1) Feed a ramp signal to the input port lb_genInp of the integrator block with a of slope = 1 for 5 s. Set initial condition lb_genInitCond to 0.0. Set Reset flag lb_bolRset to FALSE
      Expected result
      1) The block shall output integrated values according to specified sampling time lb_parSampTime
      Note
      Parameters lb_parSampTime, lb_parIntgGain, lb_parOutpDataType and lb_bolSatFlag are present on the Mask of the integrator block which can be accessed by double clicking the integrator block
    model mut_discrete_time_integrator, harness th_discrete_time_integrator, stop time 6
    parameter set "Parameter Set 1": parSampTime = 0.02  % dd_discrete_time_integrator.sldd

  case "test_case_4" [simulation]
    description: Scope
      This test shall check if the block saturates the output with respect to the specified upper and lower limit
      Parameters
      - Set Integral gain lb_parIntgGain to 1.0 with a predefined datatype for this parameter
      - Set output data type lb_parOutpDataType to Inherit: Inherit via back propagation
      - Enable Output saturation lb_bolSatFlag
      - Set sampling time lb_parSampTime to 0.01 [s] with a predefined datatype for this parameter
      Test procedure
      1) Feed a ramp signal to lb_genInp of the integrator block with a slope = 1 for 5 [s]. Set initial condition lb_genInitCond to 0.0. Set Reset flag lb_bolRset to FALSE. Feed Lower lb_genLowLim and upper lb_genUpLim limit ports with the values 2.0 and 10.0, respectively
      Expected result
      1) The output of the block shall saturate between lower lb_genLowLim and upper lb_genUpLim limits
      Note
      Parameters lb_parSampTime, lb_parIntgGain, lb_parOutpDataType and lb_bolSatFlag are present on the Mask of the integrator block which can be accessed by double clicking the integrator block
    model mut_discrete_time_integrator, harness th_discrete_time_integrator, stop time 6
    parameter set "Parameter Set 1": parLowLimInitVal = 2, parSatFlag = true, parUpLimInitVal = 10  % dd_discrete_time_integrator.sldd
    post-load callback:
      CurrentDir = pwd;
      load_system([CurrentDir,'\test_harnesses\discrete_time_integrator\mut_discrete_time_integrator.slx']);
      set_param('mut_discrete_time_integrator/lib_DiscreteTimeIntegrator_mut','lb_parSatFlag','on');
    cleanup callback:
      CurrentDir = pwd;
      set_param('mut_discrete_time_integrator/lib_DiscreteTimeIntegrator_mut','lb_parSatFlag','off');
      save_system([CurrentDir,'\test_harnesses\discrete_time_integrator\mut_discrete_time_integrator.slx']);