% Simulink data dictionary dd_test_harness_data.sldd
% references dd_model_under_test_data.sldd

th_parPWMMode = Simulink.Parameter(4, DataType="uint8")
th_parSimModeFlag = Simulink.Parameter(false, DataType="boolean")
th_parOutp2TestTol = Simulink.Parameter(0.0001, DataType="double")
th_parTestProcElctAngIndx = Simulink.Parameter(1, DataType="uint16")
th_parTestProcDQVoltAngIndx = Simulink.Parameter(1, DataType="uint16")
th_parTestProcActElctSpdIndx = Simulink.Parameter(1, DataType="uint16")
th_parTestProcReacTimeIndx = Simulink.Parameter(1, DataType="uint16")
th_parTestProcSensFlagIndx = Simulink.Parameter(1, DataType="uint16")
th_parTestProcSplyVoltIndx = Simulink.Parameter(1, DataType="uint16")
th_parTestProcVoltAmpIndx = Simulink.Parameter(1, DataType="uint16")
th_parOutp1TestTol = Simulink.Parameter(0.01, DataType="double")