test file "tf_duty_cycle_waveform_generator"
  coverage: Decision, MCDC, SignalRange, RelationalBoundary, Condition, LookupTable, SaturationOnIntOverflow

suite "smoke_test"

  case "test_case_1" [baseline]
    model mut_duty_cycle_waveform_generator, harness th_duty_cycle_waveform_generator, stop time 1
    parameter set "Parameter Set 1":
      lb_parSimModeFlag = off  % mask workspace, mut_duty_cycle_waveform_generator/lib_DutyCycleWaveformGenerator_mut
      parOmodFact = 1  % dd_model_under_test_data.sldd
      th_parPWMMode = 4  % dd_test_harness_data.sldd
      th_parSimModeFlag = false  % dd_test_harness_data.sldd
    post-load callback:
      sltest.testsequence.activateScenario([sltest_bdroot,'/sss_InputSignalGenerator/tsq_vtVoltAmp'],...
          'Scenario_2');
    custom criteria:
      %% Req. XXX_014
      lb_arQAlinDQVoltAng = double(test.sltest_simout.get('logsout').get('lb_arQAlinDQVoltAng').Values.Data);
      th_arQAlinDQVoltAng = double(test.sltest_simout.get('logsout').get('th_arQAlinDQVoltAng').Values.Data);
      error = abs(lb_arQAlinDQVoltAng-th_arQAlinDQVoltAng);
      tol = 2*pi/1000;
      test.verifyEqual(all(error <= tol),true,'Actual and expected DQ voltage angle aligned to Q-axis match');

      %% Req. XXX_015, XXX_016
      lb_arCommAng = double(test.sltest_simout.get('logsout').get('lb_arCommAng').Values.Data);
      th_arCommAng = double(test.sltest_simout.get('logsout').get('th_arCommAng').Values.Data);
      error = abs(lb_arCommAng-th_arCommAng);
      tol = 2*pi/1000;
      test.verifyEqual(all(error <= tol),true,'Actual and expected commutation angle match');

      %% Req. XXX_017, XXX_018
      lb_parShpFact = double(test.sltest_simout.get('logsout').get('lb_parShpFact').Values.Data);
      th_parShpFact = double(test.sltest_simout.get('logsout').get('th_parShpFact').Values.Data);
      error = abs(lb_parShpFact-th_parShpFact);
      tol = 1e-3;
      test.verifyEqual(all(error <= tol),true,'Actual and expected shape factor match');

      %% Req. XXX_019
      lb_genMaxNormVoltAmp = double(test.sltest_simout.get('logsout').get('lb_genMaxNormVoltAmp').Values.Data);
      th_genMaxNormVoltAmp = double(test.sltest_simout.get('logsout').get('th_genMaxNormVoltAmp').Values.Data);
      error = abs(lb_genMaxNormVoltAmp-th_genMaxNormVoltAmp);
      tol = 1e-3;
      test.verifyEqual(all(error <= tol),true,'Actual and expected maximum normalized voltage amplitude match');

      %% Req. XXX_021
      lb_vtLtdVoltAmp = double(test.sltest_simout.get('logsout').get('lb_vtLtdVoltAmp').Values.Data);
      th_vtLtdVoltAmp = double(test.sltest_simout.get('logsout').get('th_vtLtdVoltAmp').Values.Data);
      error = abs(lb_vtLtdVoltAmp-th_vtLtdVoltAmp);
      tol = 60*1e-3;
      test.verifyEqual(all(error <= tol),true,'Actual and expected limited voltage amplitude match');

      %% Req. XXX_022
      lb_genNormVoltAmp = double(test.sltest_simout.get('logsout').get('lb_genNormVoltAmp').Values.Data);
      th_genNormVoltAmp = double(test.sltest_simout.get('logsout').get('th_genNormVoltAmp').Values.Data);
      error = abs(lb_genNormVoltAmp-th_genNormVoltAmp);
      tol = 1e-3;
      test.verifyEqual(all(error <= tol),true,'Actual and expected normalized voltage amplitude match');